# Grasshopper definition 2023.02.05_Site Radiation Analysis.gh (Grasshopper 1.0.7)
# plug-ins: HFTidyCanvas, Human

rhino_project_units = ValueList({"Millimeters", "Centimeters", "Meters", "Inches", "Feet"}, selected="Millimeters")
panel = Panel("https://energyplus-weather.s3.amazonaws.com/africa_wmo_region_1/ZAF/ZAF_Cape.Town.688160_IWEC/ZAF_Cape.Town.688160_IWEC.zip")
# https://energyplus-weather.s3.amazonaws.com/africa_wmo_region_1/ZAF/ZAF_Cape.Town.688160_IWEC/ZAF_Cape.Town.688160_IWEC.zip
number_slider = Slider(4, range=1..9)
# LB_CapeTown
# AG_2023.02.05
number_slider_2 = Slider(9, range=1..12)
data_dam = DataDam(DataDataA=panel, BufferDelay=10000000, BufferMode=0)
downloadepw = LBDownloadWeather(weather_URL=data_dam)  # -> epw_file, stat_file, ddy_file; plug-in component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
geometry = Geometry([<brep referenced from the Rhino model>, <curve referenced from the Rhino model> x2, <brep referenced from the Rhino model> x59])
analysisperiod = LBAnalysisPeriod(
    start_month=Slider(9, range=1..12),
    start_day=Slider(1, range=1..28),
    start_hour=Slider(1, range=1..24),
    end_month=Slider(4, range=1..12),
    end_day=Slider(1, range=1..28),
    end_hour=Slider(19.66, range=0..100),
    timestep=Slider(1, range=1..24))  # -> period, hoys, dates; plug-in component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
analysisperiod_2 = LBAnalysisPeriod(
    start_month=number_slider,
    start_day=Slider(1, range=1..28),
    start_hour=Slider(1, range=1..24),
    end_month=Slider(9, range=6..19),
    end_day=Slider(1, range=1..28),
    end_hour=Slider(23, range=0..100),
    timestep=Slider(1, range=1..24))  # -> period, hoys, dates; plug-in component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
analysisperiod_3 = LBAnalysisPeriod(
    start_month=number_slider_2,
    start_day=Slider(1, range=1..28),
    start_hour=Slider(1, range=1..24),
    end_month=Slider(3, range=1..12),
    end_day=Slider(1, range=1..28),
    end_hour=Slider(23, range=0..100),
    timestep=Slider(1, range=1..24))  # -> period, hoys, dates; plug-in component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
importepw = LBImportEPW(epw_file=downloadepw.epw_file)  # -> location, dry_bulb_temperature, dew_point_temperature, relative_humidity, wind_speed, wind_direction, direct_normal_rad, diffuse_horizontal_rad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; plug-in component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

# ----
# Sky Dome
number_slider_3 = Slider(9, range=1..12)
analysisperiod_4 = LBAnalysisPeriod(
    start_month=Slider(6, range=1..12),
    start_day=Slider(1, range=1..28),
    start_hour=Slider(1, range=1..24),
    end_month=number_slider_3,
    end_day=Slider(1, range=1..28),
    end_hour=Slider(23, range=0..100),
    timestep=Slider(1, range=1..24))  # -> period, hoys, dates; plug-in component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
data_dam_2 = DataDam(DataDataA=analysisperiod_4.hoys, BufferDelay=10000000, BufferMode=0)
skymatrix = LBCumulativeSkyMatrix(
    location=importepw.location,
    direct_rad=importepw.direct_normal_rad,
    diffuse_rad=importepw.diffuse_horizontal_rad,
    hoys=data_dam_2)  # -> out, sky_mtx; plug-in component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
skydome = LBSkyDome(sky_mtx=skymatrix.sky_mtx)  # -> out, mesh, compass, legend, title, patch_vecs, patch_values, mesh_values, vis_set; disabled; plug-in component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

radrose = LBRadiationRose(sky_mtx=skymatrix.sky_mtx, arrow_scale=1)  # -> out, mesh, compass, orient_lines, legend, title, dir_vecs, dir_values, vis_set; plug-in component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
data_dam_3 = DataDam(DataDataA=analysisperiod.hoys, BufferDelay=10000000, BufferMode=0)
data_dam_4 = DataDam(DataDataA=analysisperiod_2.hoys, BufferDelay=10000000, BufferMode=0)
data = Data(radrose.legend)
vector = Vector(Vector(-218.7702788, -2.259258145, 0))
sunpath = LBSunPath(north=vector, location=importepw.location, hoys=analysisperiod_4.hoys, scale=Slider(1.5, range=0..2))  # -> out, vectors, altitudes, azimuths, hoys, sun_pts, analemma, daily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; plug-in component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
windrose = LBWindRose(data=importepw.wind_speed, wind_direction=importepw.wind_direction)  # -> out, mesh, compass, orient_line, freq_line, windrose_line, legend, title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; plug-in component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
hourlyplot = LBHourlyPlot(data=importepw.wind_speed)  # -> out, mesh, legend, borders, labels, title, vis_set; disabled; plug-in component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
hourlyplot_2 = LBHourlyPlot(data=importepw.relative_humidity)  # -> out, mesh, legend, borders, labels, title, vis_set; disabled; plug-in component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
number_slider_4 = Slider(1.04, range=0..10)
sunpath_2 = LBSunPath(location=importepw.location, hoys=data_dam_4, scale=number_slider_4)  # -> out, vectors, altitudes, azimuths, hoys, sun_pts, analemma, daily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; plug-in component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
sunpath_3 = LBSunPath(location=importepw.location, hoys=data_dam_3, scale=number_slider_4)  # -> out, vectors, altitudes, azimuths, hoys, sun_pts, analemma, daily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; plug-in component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
sphere = Sphere(Base=sunpath_3.sun_pts, Radius=1)
sphere_2 = Sphere(Base=sunpath_2.sun_pts, Radius=1)
data_2 = Data(sunpath.analemma)
data_3 = Data(sunpath.daily)
data_4 = Data(sunpath.compass)
data_data_a = DataDescription(data_dam_2)
custom_preview_lineweights = CustomPreviewLineweights(
    Geometry=data_3,
    Shader={diffuse=RGB(255, 105, 180), emission=RGB(76, 32, 54), shine=0.5, specular=RGB(255, 255, 255), transparency=0},
    Absolute=False)
hourlyplot_3 = LBHourlyPlot(data=importepw.direct_normal_rad)  # -> out, mesh, legend, borders, labels, title, vis_set; disabled; plug-in component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
sphere_3 = Sphere(Base=sunpath.sun_pts, Radius=1)
sunpath_4 = LBSunPath(location=importepw.location, hoys=data_data_a, scale=number_slider_4)  # -> out, vectors, altitudes, azimuths, hoys, sun_pts, analemma, daily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; plug-in component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
custom_preview = CustomPreview(Geometry=sphere_3, Material=ColourSwatch(SwatchColor=RGB(85, 255, 0)))
psychrometricchart = LBPsychrometricChart(temperature=importepw.dry_bulb_temperature, rel_humidity=importepw.relative_humidity)  # -> out, title, temp_lines, rh_lines, hr_lines, enth_wb_lines, mesh, legend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; disabled; plug-in component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
radiationdome = LBRadiationDome(sky_mtx=skymatrix.sky_mtx, scale=1)  # -> out, mesh, compass, legend, title, dir_vecs, dir_values, max_pt, max_info, vis_set; disabled; plug-in component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
radrose_2 = LBRadiationRose(sky_mtx=skymatrix.sky_mtx, arrow_scale=1)  # -> out, mesh, compass, orient_lines, legend, title, dir_vecs, dir_values, vis_set; disabled; plug-in component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
straight_wall = Brep(<brep referenced from the Rhino model>)
slanting_wall = Brep(<brep referenced from the Rhino model>)
analysing_geometry = Brep([<brep referenced from the Rhino model> x59])
buildings = Brep([<brep referenced from the Rhino model> x37])
context_geometry = Brep([<brep referenced from the Rhino model> x3])
stream_filter = StreamFilter(Gate=Toggle(True), Stream0=straight_wall, Stream1=slanting_wall)
context = Brep([<brep referenced from the Rhino model> x9])
merge = Merge(Data1=context, Data2=buildings, Data3=stream_filter)
site = Brep(<brep referenced from the Rhino model>)
directsunhours = LBDirectSunHours(
    vectors=flatten(sunpath.vectors),
    geometry=flatten(site),
    context=flatten(merge),
    grid_size=Slider(0.26, range=0..1),
    run=Toggle(False))  # -> out, points, results, mesh, legend, title, int_mtx; plug-in component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
incidentradiation = LBIncidentRadiation(
    sky_mtx=skymatrix.sky_mtx,
    geometry=flatten(analysing_geometry),
    context=flatten(context_geometry),
    grid_size=Slider(1.2, range=0..10),
    run=Toggle(False))  # -> out, points, results, total, mesh, legend, title, int_mtx; plug-in component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
unit_x = UnitX(Factor=Slider(0, range=0..100))
unit_z = UnitZ(Factor=1)
data_5 = Data(directsunhours.mesh)
data_6 = Data(directsunhours.legend)
unit_x_2 = UnitX(Factor=Slider(72.48, range=0..110))
data_7 = Data(incidentradiation.legend)
move = Move(Geometry=data_7, Motion=unit_x)  # -> Geometry, Transform
move_2 = Move(Geometry=data_6, Motion=unit_x_2)  # -> Geometry, Transform
data_8 = Data(incidentradiation.mesh)
