# Grasshopper definition 2023.03.02_for hyperbolas.gh (Grasshopper 1.0.8)
# plug-ins: Heteroptera, treesloth01, Pufferfish, Tree8, Weaverbird, HFTidyCanvas

# After Gaudi
# Wall Grid
rhino_project_units = ValueList({"Millimeters", "Centimeters", "Meters", "Inches", "Feet"}, selected="Meters")  # disabled
curve = Curve(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)  # disabled
curve_2 = Curve(<curve referenced from the Rhino model>)  # disabled
ruled_surface = RuledSurface(CurveA=curve, CurveB=curve_2)  # disabled

base_surface = Surface(<surface referenced from the Rhino model>)  # disabled
surface = DataDescription(base_surface)  # disabled
dimensions = Dimensions(Surface=surface)  # -> UDimension, VDimension; disabled
number_slider = Slider(2.4, range=0..10)  # disabled
division = Division(A=dimensions.UDimension, B=number_slider)  # disabled
division_2 = Division(A=dimensions.VDimension, B=number_slider)  # disabled
round = Round(Number=division)  # -> Nearest, Floor, Ceiling; disabled
round_2 = Round(Number=division_2)  # -> Nearest, Floor, Ceiling; disabled
divide_surface = DivideSurface(Surface=surface, UCount=round.Ceiling, VCount=round_2.Ceiling)  # -> Points, Normals, Parameters; disabled
evaluate_surface = EvaluateSurface(Surface=surface, Point=divide_surface.Parameters)  # -> Point, Normal, UDirection, VDirection, Frame; disabled
clean_tree = CleanTree(RemoveNulls=True, RemoveInvalid=True, RemoveEmpty=False, Tree=evaluate_surface.Frame)  # disabled
tree_statistics = TreeStatistics(Tree=clean_tree)  # -> Paths, Length, Count; disabled
flip_matrix = FlipMatrix(Data=clean_tree)  # disabled
panel = Panel("""0
-1""")  # disabled
list_item = ListItem(List=tree_statistics.Paths, Index=0, Wrap=invert(True))  # -> Item1, Item; disabled
cull_index = CullIndex(List=flip_matrix, Indices=panel, Wrap=True)  # disabled
merge = Merge(Data1=list_item.Item1, Data2=list_item.Item)  # disabled
flip_matrix_2 = FlipMatrix(Data=cull_index)  # disabled
cull_index_2 = CullIndex(List=flip_matrix_2, Indices=panel, Wrap=True)  # disabled
number_slider_2 = Slider(1.2, range=0..10)  # disabled
flip_matrix_3 = FlipMatrix(Data=cull_index_2)  # disabled
plane = Plane(flip_matrix_3)  # disabled
point_list = PointList(Points=plane, Size=number_slider_2)  # disabled
hyperboloid_plane = DataDescription(plane)  # disabled
plane_2 = Plane(hyperboloid_plane)  # disabled
number_slider_3 = Slider(34, range=0..180)  # disabled
unit_x = UnitX(Factor=1)  # disabled
deconstruct_plane = DeconstructPlane(Plane=plane_2)  # -> Origin, XAxis, YAxis, ZAxis; disabled
radians = Radians(Degrees=number_slider_3)  # disabled
number_slider_4 = Slider(20, range=0..180)  # disabled
negative = Negative(Value=unit_x)  # disabled
radians_2 = Radians(Degrees=number_slider_4)  # disabled
line_sdl = LineSDL(Start=deconstruct_plane.Origin, Direction=Vector(0, 0, 1), Length=1)  # disabled
rotate_plane = RotatePlane()  # disabled
vector = Vector(Vector(-14.09538931, -5.13030215, -3.549160965e-11))  # disabled
line_sdl_2 = LineSDL(Start=plane_2, Direction=negative, Length=1)  # disabled
number_slider_5 = Slider(48.99, range=0..90)  # disabled
radius_a = Slider(0.21, range=0..10)  # disabled
radius_b = Slider(0.25, range=0..10)  # disabled
number_slider_6 = Slider(1, range=0..30)  # disabled
rotate = Rotate(Geometry=line_sdl_2, Angle=radians_2, Plane=deconstruct_plane.Origin)  # -> Geometry, Transform; disabled
rad = Radians(Degrees=number_slider_5)  # disabled
rtrig = RightTrigonometry(Alpha=rad, PLength=radius_a)  # -> Alpha, Beta, PLength, QLength, RLength; disabled
vector_2 = Vector(rotate.Geometry)  # disabled
number_slider_7 = Slider(29, range=0..1000)  # disabled
python = GhPythonScript(a=radius_a, b=radius_b, c=rtrig.QLength, depth=number_slider_6, h=number_slider_6)  # -> out, hyperboloid, hyperbola; disabled
# ---------- python: Python ----------
__author__ = "ashkan"
__version__ = "2021.03.29"

import rhinoscriptsyntax as rs
import scriptcontext
import math

def get_hyperbola(a, c, h) :
    """
    Draws a hyperbola on the XZ plane, centred at 0,0,0.
    """
    
    p0 = [0,0,0]
    p1 = [0,0,0]
    p2 = [0,0,0]
    q = [0,0,0]

    p0[0] = math.sqrt(a**2 * (1 + (h**2 / c**2)))
    p0[2] = h

    p1[0] = (-1 * p0[2]**2 * a**2) / (c**2 * p0[0]) + p0[0]
    p1[2] = 0

    p2[0] = p0[0]
    p2[2] = -h

    q[0] = a
    q[2] = 0

    w1 = (p0[0]-q[0]) / (q[0]-p1[0])

    points = [rs.AddPoint(p0), rs.AddPoint(p1), rs.AddPoint(p2)]
    knots = [0,0,1,1]
    weights = [1,w1,1]
    
    hyperbola = rs.AddNurbsCurve(points,knots,2,weights)
    print(rs.CurveWeights(hyperbola))


    return hyperbola

def get_hyperboloid(a, b, c, depth) :
    hyperbola = get_hyperbola(a, c, depth)   
    axis = rs.AddLine(rs.AddPoint(0,0,0),rs.AddPoint(0,0,1))
    hyperboloid = rs.AddRevSrf(hyperbola,axis)
    
    y_factor = float(b) / float(a)
    hyperboloid = rs.ScaleObject(hyperboloid, rs.AddPoint(0,0,0), [1,y_factor,1])
    return hyperboloid
    
hyperboloid = get_hyperboloid(a, b, c, depth)
hyperbola = get_hyperbola (a,c,h)
# ---------- end python ----------
cross_product = CrossProduct(VectorA=vector_2, VectorB=line_sdl, Unitize=False)  # -> Vector, Length; disabled
construct_plane = ConstructPlane(Origin=deconstruct_plane.Origin, XAxis=cross_product.Vector, YAxis=line_sdl)  # disabled
hyperboloid_plane_2 = HyperboloidPlane(construct_plane)  # disabled
radians_3 = Radians(Degrees=number_slider_7)  # disabled
cap = CapHoles(Brep=python.hyperboloid)  # disabled
construct_plane_2 = ConstructPlane(Origin=construct_plane, XAxis=vector_2, YAxis=Vector(0, 1, 0))  # disabled
plane_3 = Plane(construct_plane)  # disabled
hyperboloid___brep = DataDescription(cap)  # disabled
hyperboloid___brep_2 = Hyperboloid_Srf(hyperboloid___brep)  # disabled
hyperboloid___brep_3 = Hyperboloid_Brep(hyperboloid___brep_2)  # disabled
orient = Orient(Geometry=hyperboloid___brep_3, Source=PlaneXY(0, 0, 0), Target=hyperboloid_plane_2)  # -> Geometry, Transform; disabled
oriented_hyperboloids = DataDescription(orient.Geometry)  # disabled
oriented_hyperboloids_2 = Geometry(oriented_hyperboloids)  # disabled
rotate_3d = Rotate3D(Geometry=plane_3, Angle=radians_3, Center=plane_3, Axis=cross_product.Vector)  # -> Geometry, Transform; disabled
final_wall = Brep(<brep referenced from the Rhino model>)  # disabled
boolean_toggle = BooleanToggle(False)  # disabled
oriented_hyperboloids_3 = OrientedHyperboloids(oriented_hyperboloids_2)  # disabled
solid_wall = Surface(final_wall)  # disabled
flatten = FlattenTree(Tree=oriented_hyperboloids_3, Path="{0}")  # disabled
dispatch = Dispatch(List=flatten, DispatchPattern=boolean_toggle)  # -> ListA, ListB; disabled
sdiff = SolidDifference(BrepsA=solid_wall, BrepsB=dispatch.ListA)  # disabled
perforated_wall___brep = DataDescription(sdiff)  # disabled

base_surface_2 = Surface(<surface referenced from the Rhino model>)  # disabled
surface_2 = DataDescription(base_surface_2)  # disabled
dimensions_2 = Dimensions(Surface=surface_2)  # -> UDimension, VDimension; disabled
number_slider_8 = Slider(2.4, range=0..10)  # disabled
division_3 = Division(A=dimensions_2.UDimension, B=number_slider_8)  # disabled
division_4 = Division(A=dimensions_2.VDimension, B=number_slider_8)  # disabled
round_3 = Round(Number=division_3)  # -> Nearest, Floor, Ceiling; disabled
round_4 = Round(Number=division_4)  # -> Nearest, Floor, Ceiling; disabled
divide_surface_2 = DivideSurface(Surface=surface_2, UCount=round_3.Ceiling, VCount=round_4.Ceiling)  # -> Points, Normals, Parameters; disabled
evaluate_surface_2 = EvaluateSurface(Surface=surface_2, Point=divide_surface_2.Parameters)  # -> Point, Normal, UDirection, VDirection, Frame; disabled
clean_tree_2 = CleanTree(RemoveNulls=True, RemoveInvalid=True, RemoveEmpty=False, Tree=evaluate_surface_2.Frame)  # disabled
tree_statistics_2 = TreeStatistics(Tree=clean_tree_2)  # -> Paths, Length, Count; disabled
flip_matrix_4 = FlipMatrix(Data=clean_tree_2)  # disabled
panel_2 = Panel("""0
-1""")  # disabled
list_item_2 = ListItem(List=tree_statistics_2.Paths, Index=0, Wrap=invert(True))  # -> Item1, Item; disabled
cull_index_3 = CullIndex(List=flip_matrix_4, Indices=panel_2, Wrap=True)  # disabled
merge_2 = Merge(Data1=list_item_2.Item1, Data2=list_item_2.Item)  # disabled
flip_matrix_5 = FlipMatrix(Data=cull_index_3)  # disabled
cull_index_4 = CullIndex(List=flip_matrix_5, Indices=panel_2, Wrap=True)  # disabled
number_slider_9 = Slider(1.2, range=0..10)  # disabled
flip_matrix_6 = FlipMatrix(Data=cull_index_4)  # disabled
plane_4 = Plane(flip_matrix_6)  # disabled
point_list_2 = PointList(Points=plane_4, Size=number_slider_9)  # disabled
hyperboloid_plane_3 = DataDescription(plane_4)  # disabled
plane_5 = Plane(hyperboloid_plane_3)  # disabled
number_slider_10 = Slider(34, range=0..180)  # disabled
unit_x_2 = UnitX(Factor=1)  # disabled
deconstruct_plane_2 = DeconstructPlane(Plane=plane_5)  # -> Origin, XAxis, YAxis, ZAxis; disabled
radians_4 = Radians(Degrees=number_slider_10)  # disabled
number_slider_11 = Slider(20, range=0..180)  # disabled
negative_2 = Negative(Value=unit_x_2)  # disabled
radians_5 = Radians(Degrees=number_slider_11)  # disabled
line_sdl_3 = LineSDL(Start=deconstruct_plane_2.Origin, Direction=Vector(0, 0, 1), Length=1)  # disabled
rotate_plane_2 = RotatePlane()  # disabled
vector_3 = Vector(Vector(-14.09538931, -5.13030215, -3.549160965e-11))  # disabled
line_sdl_4 = LineSDL(Start=plane_5, Direction=negative_2, Length=1)  # disabled
number_slider_12 = Slider(47.12, range=0..90)  # disabled
radius_a_2 = Slider(0.28, range=0..10)  # disabled
radius_b_2 = Slider(0.31, range=0..10)  # disabled
number_slider_13 = Slider(1.1, range=0..30)  # disabled
rotate_2 = Rotate(Geometry=line_sdl_4, Angle=radians_5, Plane=deconstruct_plane_2.Origin)  # -> Geometry, Transform; disabled
rad_2 = Radians(Degrees=number_slider_12)  # disabled
rtrig_2 = RightTrigonometry(Alpha=rad_2, PLength=radius_a_2)  # -> Alpha, Beta, PLength, QLength, RLength; disabled
vector_4 = Vector(rotate_2.Geometry)  # disabled
number_slider_14 = Slider(27, range=0..1000)  # disabled
python_2 = GhPythonScript(a=radius_a_2, b=radius_b_2, c=rtrig_2.QLength, depth=number_slider_13, h=number_slider_13)  # -> out, hyperboloid, hyperbola; disabled; same code as python
cross_product_2 = CrossProduct(VectorA=vector_4, VectorB=line_sdl_3, Unitize=False)  # -> Vector, Length; disabled
construct_plane_3 = ConstructPlane(Origin=deconstruct_plane_2.Origin, XAxis=cross_product_2.Vector, YAxis=line_sdl_3)  # disabled
radians_6 = Radians(Degrees=number_slider_14)  # disabled
cap_2 = CapHoles(Brep=python_2.hyperboloid)  # disabled
construct_plane_4 = ConstructPlane(Origin=construct_plane_3, XAxis=vector_4, YAxis=Vector(0, 1, 0))  # disabled
plane_6 = Plane(construct_plane_3)  # disabled
hyperboloid___brep_4 = DataDescription(cap_2)  # disabled
hyperboloid___brep_5 = Hyperboloid_Srf(hyperboloid___brep_4)  # disabled
hyperboloid___brep_6 = Hyperboloid_Brep(hyperboloid___brep_5)  # disabled
rotate_3d_2 = Rotate3D(Geometry=plane_6, Angle=radians_6, Center=plane_6, Axis=cross_product_2.Vector)  # -> Geometry, Transform; disabled
hyperboloid_plane_4 = HyperboloidPlane(rotate_3d_2.Geometry)  # disabled
orient_2 = Orient(Geometry=hyperboloid___brep_6, Source=PlaneXY(0, 0, 0), Target=hyperboloid_plane_4)  # -> Geometry, Transform; disabled
oriented_hyperboloids_4 = DataDescription(orient_2.Geometry)  # disabled
oriented_hyperboloids_5 = Geometry(oriented_hyperboloids_4)  # disabled
final_wall_2 = Brep(<brep referenced from the Rhino model>)  # disabled
boolean_toggle_2 = BooleanToggle(False)  # disabled
oriented_hyperboloids_6 = OrientedHyperboloids(oriented_hyperboloids_5)  # disabled
solid_wall_2 = Surface(final_wall_2)  # disabled
flatten_2 = FlattenTree(Tree=oriented_hyperboloids_6, Path="{0}")  # disabled
dispatch_2 = Dispatch(List=flatten_2, DispatchPattern=boolean_toggle_2)  # -> ListA, ListB; disabled
sdiff_2 = SolidDifference(BrepsA=solid_wall_2, BrepsB=dispatch_2.ListA)  # disabled
perforated_wall___brep_2 = DataDescription(sdiff_2)  # disabled

# ---- group: HYPOBOLOID GENERATION
number_slider_15 = Slider(51.82, range=0..90)  # disabled
radius_a_3 = Slider(0.19, range=0..10)  # disabled
radius_b_3 = Slider(0.18, range=0..10)  # disabled
number_slider_16 = Slider(1, range=0..30)  # disabled
rad_3 = Radians(Degrees=number_slider_15)  # disabled
rtrig_3 = RightTrigonometry(Alpha=rad_3, PLength=radius_a_3)  # -> Alpha, Beta, PLength, QLength, RLength; disabled
python_3 = GhPythonScript(a=radius_a_3, b=radius_b_3, c=rtrig_3.QLength, depth=number_slider_16, h=number_slider_16)  # -> out, hyperboloid, hyperbola; disabled; same code as python
cap_3 = CapHoles(Brep=python_3.hyperboloid)  # disabled
hyperboloid___brep_7 = DataDescription(cap_3)  # disabled

# ---- group: HYPOBOLOID GENERATION / Data Description
hyperboloid___brep_8 = Hyperboloid_Srf(hyperboloid___brep_7)  # disabled

# ----
base_surface_3 = Surface(<surface referenced from the Rhino model>)  # disabled
dimensions_3 = Dimensions(Surface=base_surface_3)  # -> UDimension, VDimension; disabled
number_slider_17 = Slider(1.8, range=0..10)  # disabled
division_5 = Division(A=dimensions_3.UDimension, B=number_slider_17)  # disabled
division_6 = Division(A=dimensions_3.VDimension, B=number_slider_17)  # disabled
round_5 = Round(Number=division_5)  # -> Nearest, Floor, Ceiling; disabled
round_6 = Round(Number=division_6)  # -> Nearest, Floor, Ceiling; disabled
divide_surface_3 = DivideSurface(Surface=base_surface_3, UCount=round_5.Ceiling, VCount=round_6.Ceiling)  # -> Points, Normals, Parameters; disabled
evaluate_surface_3 = EvaluateSurface(Surface=base_surface_3, Point=divide_surface_3.Parameters)  # -> Point, Normal, UDirection, VDirection, Frame; disabled
clean_tree_3 = CleanTree(RemoveNulls=True, RemoveInvalid=True, RemoveEmpty=False, Tree=evaluate_surface_3.Frame)  # disabled
tree_statistics_3 = TreeStatistics(Tree=clean_tree_3)  # -> Paths, Length, Count; disabled
flip_matrix_7 = FlipMatrix(Data=clean_tree_3)  # disabled
panel_3 = Panel("""0
-1""")  # disabled
list_item_3 = ListItem(List=tree_statistics_3.Paths, Index=0, Wrap=invert(True))  # -> Item1, Item; disabled
cull_index_5 = CullIndex(List=flip_matrix_7, Indices=panel_3, Wrap=True)  # disabled
flip_matrix_8 = FlipMatrix(Data=cull_index_5)  # disabled
merge_3 = Merge(Data1=list_item_3.Item1, Data2=list_item_3.Item)  # disabled
cull_index_6 = CullIndex(List=flip_matrix_8, Indices=panel_3, Wrap=True)  # disabled
plane_7 = Plane(cull_index_6)  # disabled
flip_matrix_9 = FlipMatrix(Data=plane_7)  # disabled
tree_statistics_4 = TreeStatistics(Tree=flip_matrix_9)  # -> Paths, Length, Count; disabled
dispatch_3 = Dispatch(List=tree_statistics_4.Paths, DispatchPattern=[True, False])  # -> ListA, ListB; disabled
tree_branch = TreeBranch(Tree=flip_matrix_9, Path=dispatch_3.ListA, MaintainPaths=True, SplitTree=False)  # disabled
tree_branch_2 = TreeBranch(Tree=flip_matrix_9, Path=dispatch_3.ListB, MaintainPaths=True, SplitTree=False)  # disabled
plane_8 = Plane(tree_branch)  # disabled
plane_9 = Plane(tree_branch_2)  # disabled
dispatch_4 = Dispatch(List=plane_8, DispatchPattern=[True, False])  # -> ListA, ListB; disabled
dispatch_5 = Dispatch(List=plane_9, DispatchPattern=[True, False])  # -> ListA, ListB; disabled
list_b = DataDescription(dispatch_4.ListB)  # disabled
list_a = DataDescription(dispatch_5.ListA)  # disabled
list_a_2 = DataDescription(dispatch_4.ListA)  # disabled
list_b_2 = DataDescription(dispatch_5.ListB)  # disabled
number_slider_18 = Slider(8, range=0..8)  # disabled
weave = Weave(Pattern=[0, 1], Stream0=list_b, Stream1=list_a, NullGaps=False)  # disabled
weave_2 = Weave(Pattern=[0, 1], Stream0=list_a_2, Stream1=list_b_2, NullGaps=False)  # disabled
list_item_4 = ListItem(List=weave, Index=number_slider_18, Wrap=True)  # disabled
list_item_5 = ListItem(List=weave_2, Index=number_slider_18, Wrap=True)  # disabled
line = Line(StartPoint=list_item_4, EndPoint=list_item_5)  # disabled
number_slider_19 = Slider(0.34, range=0.01..10)  # disabled
length = Length(Curve=line)  # disabled
multiplication = Multiplication(A=length, B=number_slider_19)  # disabled
circle = Circle(Plane=weave, Radius=multiplication)  # disabled
number_slider_20 = Slider(4, range=0..10)  # disabled
divide_curve = DivideCurve(Curve=circle, Count=number_slider_20, Kinks=False)  # -> Points, Tangents, Parameters; disabled
surface_closest_point = SurfaceClosestPoint(Point=divide_curve.Points, Surface=base_surface_3)  # -> Point, UVPoint, Distance; disabled
evaluate_surface_4 = EvaluateSurface(Surface=base_surface_3, Point=surface_closest_point.UVPoint)  # -> Point, Normal, UDirection, VDirection, Frame; disabled
number_slider_21 = Slider(0.17, range=0..1)  # disabled
plane_10 = Plane(evaluate_surface_4.Frame)  # disabled
negative_3 = Negative(Value=number_slider_21)  # disabled
plane_offset = PlaneOffset(BasePlane=plane_10, Offset=negative_3)  # disabled
number_slider_22 = Slider(15, range=0..180)  # disabled
radians_7 = Radians(Degrees=number_slider_22)  # disabled
center = Center(Geometric=plane_offset)  # -> Center, Dimension; disabled
deconstruct_plane_3 = DeconstructPlane(Plane=plane_offset)  # -> Origin, XAxis, YAxis, ZAxis; disabled
negative_4 = Negative(Value=radians_7)  # disabled
rotate_3d_3 = Rotate3D(Geometry=plane_offset, Angle=negative_4, Center=center.Center, Axis=deconstruct_plane_3.Origin)  # -> Geometry, Transform; disabled
dispatch_6 = Dispatch(List=rotate_3d_3.Geometry, DispatchPattern=[True, False])  # -> ListA, ListB; disabled
list_a_3 = DataDescription(dispatch_6.ListA)  # disabled
number_slider_23 = Slider(0, range=0..1)  # disabled
list_b_3 = DataDescription(dispatch_6.ListB)  # disabled
number_slider_24 = Slider(41, range=0..180)  # disabled
list_length = ListLength(List=list_a_3)  # disabled
negative_5 = Negative(Value=number_slider_23)  # disabled
radians_8 = Radians(Degrees=number_slider_24)  # disabled
merge_4 = Merge(Data1=number_slider_23, Data2=negative_5)  # disabled
negative_6 = Negative(Value=radians_8)  # disabled
unit_z = UnitZ(Factor=merge_4)  # disabled
merge_5 = Merge(Data1=radians_8, Data2=negative_6)  # disabled
move = Move(Geometry=list_b_3, Motion=unit_z)  # -> Geometry, Transform; disabled
repeat_data = RepeatData(Data=merge_5, Length=list_length)  # disabled
rotate_plane_3 = RotatePlane(Plane=list_a_3, Angle=repeat_data)  # disabled
merge_6 = Merge(Data1=rotate_plane_3, Data2=move.Geometry)  # disabled

base_surface_4 = Surface(<surface referenced from the Rhino model>)  # disabled
dimensions_4 = Dimensions(Surface=base_surface_4)  # -> UDimension, VDimension; disabled
number_slider_25 = Slider(1.8, range=0..10)  # disabled
division_7 = Division(A=dimensions_4.UDimension, B=number_slider_25)  # disabled
division_8 = Division(A=dimensions_4.VDimension, B=number_slider_25)  # disabled
round_7 = Round(Number=division_7)  # -> Nearest, Floor, Ceiling; disabled
round_8 = Round(Number=division_8)  # -> Nearest, Floor, Ceiling; disabled
divide_surface_4 = DivideSurface(Surface=base_surface_4, UCount=round_7.Ceiling, VCount=round_8.Ceiling)  # -> Points, Normals, Parameters; disabled
evaluate_surface_5 = EvaluateSurface(Surface=base_surface_4, Point=divide_surface_4.Parameters)  # -> Point, Normal, UDirection, VDirection, Frame; disabled
clean_tree_4 = CleanTree(RemoveNulls=True, RemoveInvalid=True, RemoveEmpty=False, Tree=evaluate_surface_5.Frame)  # disabled
tree_statistics_5 = TreeStatistics(Tree=clean_tree_4)  # -> Paths, Length, Count; disabled
flip_matrix_10 = FlipMatrix(Data=clean_tree_4)  # disabled
panel_4 = Panel("""0
-1""")  # disabled
list_item_6 = ListItem(List=tree_statistics_5.Paths, Index=0, Wrap=invert(True))  # -> Item1, Item; disabled
cull_index_7 = CullIndex(List=flip_matrix_10, Indices=panel_4, Wrap=True)  # disabled
flip_matrix_11 = FlipMatrix(Data=cull_index_7)  # disabled
merge_7 = Merge(Data1=list_item_6.Item1, Data2=list_item_6.Item)  # disabled
cull_index_8 = CullIndex(List=flip_matrix_11, Indices=panel_4, Wrap=True)  # disabled
plane_11 = Plane(cull_index_8)  # disabled
flip_matrix_12 = FlipMatrix(Data=plane_11)  # disabled
tree_statistics_6 = TreeStatistics(Tree=flip_matrix_12)  # -> Paths, Length, Count; disabled
dispatch_7 = Dispatch(List=tree_statistics_6.Paths, DispatchPattern=[True, False])  # -> ListA, ListB; disabled
tree_branch_3 = TreeBranch(Tree=flip_matrix_12, Path=dispatch_7.ListA, MaintainPaths=True, SplitTree=False)  # disabled
tree_branch_4 = TreeBranch(Tree=flip_matrix_12, Path=dispatch_7.ListB, MaintainPaths=True, SplitTree=False)  # disabled
plane_12 = Plane(tree_branch_3)  # disabled
plane_13 = Plane(tree_branch_4)  # disabled
dispatch_8 = Dispatch(List=plane_12, DispatchPattern=[True, False])  # -> ListA, ListB; disabled
dispatch_9 = Dispatch(List=plane_13, DispatchPattern=[True, False])  # -> ListA, ListB; disabled
list_b_4 = DataDescription(dispatch_8.ListB)  # disabled
list_a_4 = DataDescription(dispatch_9.ListA)  # disabled
list_a_5 = DataDescription(dispatch_8.ListA)  # disabled
list_b_5 = DataDescription(dispatch_9.ListB)  # disabled
number_slider_26 = Slider(8, range=0..8)  # disabled
weave_3 = Weave(Pattern=[0, 1], Stream0=list_b_4, Stream1=list_a_4, NullGaps=False)  # disabled
weave_4 = Weave(Pattern=[0, 1], Stream0=list_a_5, Stream1=list_b_5, NullGaps=False)  # disabled
list_item_7 = ListItem(List=weave_3, Index=number_slider_26, Wrap=True)  # disabled
list_item_8 = ListItem(List=weave_4, Index=number_slider_26, Wrap=True)  # disabled
line_2 = Line(StartPoint=list_item_7, EndPoint=list_item_8)  # disabled
number_slider_27 = Slider(0.34, range=0.01..10)  # disabled
length_2 = Length(Curve=line_2)  # disabled
multiplication_2 = Multiplication(A=length_2, B=number_slider_27)  # disabled
circle_2 = Circle(Plane=weave_3, Radius=multiplication_2)  # disabled
number_slider_28 = Slider(4, range=0..10)  # disabled
divide_curve_2 = DivideCurve(Curve=circle_2, Count=number_slider_28, Kinks=False)  # -> Points, Tangents, Parameters; disabled
surface_closest_point_2 = SurfaceClosestPoint(Point=divide_curve_2.Points, Surface=base_surface_4)  # -> Point, UVPoint, Distance; disabled
evaluate_surface_6 = EvaluateSurface(Surface=base_surface_4, Point=surface_closest_point_2.UVPoint)  # -> Point, Normal, UDirection, VDirection, Frame; disabled
number_slider_29 = Slider(0.17, range=0..1)  # disabled
plane_14 = Plane(evaluate_surface_6.Frame)  # disabled
negative_7 = Negative(Value=number_slider_29)  # disabled
plane_offset_2 = PlaneOffset(BasePlane=plane_14, Offset=negative_7)  # disabled
number_slider_30 = Slider(15, range=0..180)  # disabled
radians_9 = Radians(Degrees=number_slider_30)  # disabled
center_2 = Center(Geometric=plane_offset_2)  # -> Center, Dimension; disabled
deconstruct_plane_4 = DeconstructPlane(Plane=plane_offset_2)  # -> Origin, XAxis, YAxis, ZAxis; disabled
negative_8 = Negative(Value=radians_9)  # disabled
rotate_3d_4 = Rotate3D(Geometry=plane_offset_2, Angle=negative_8, Center=center_2.Center, Axis=deconstruct_plane_4.Origin)  # -> Geometry, Transform; disabled
dispatch_10 = Dispatch(List=rotate_3d_4.Geometry, DispatchPattern=[True, False])  # -> ListA, ListB; disabled
list_a_6 = DataDescription(dispatch_10.ListA)  # disabled
number_slider_31 = Slider(0, range=0..1)  # disabled
list_b_6 = DataDescription(dispatch_10.ListB)  # disabled
number_slider_32 = Slider(41, range=0..180)  # disabled
list_length_2 = ListLength(List=list_a_6)  # disabled
negative_9 = Negative(Value=number_slider_31)  # disabled
radians_10 = Radians(Degrees=number_slider_32)  # disabled
merge_8 = Merge(Data1=number_slider_31, Data2=negative_9)  # disabled
negative_10 = Negative(Value=radians_10)  # disabled
unit_z_2 = UnitZ(Factor=merge_8)  # disabled
merge_9 = Merge(Data1=radians_10, Data2=negative_10)  # disabled
move_2 = Move(Geometry=list_b_6, Motion=unit_z_2)  # -> Geometry, Transform; disabled
repeat_data_2 = RepeatData(Data=merge_9, Length=list_length_2)  # disabled
rotate_plane_4 = RotatePlane(Plane=list_a_6, Angle=repeat_data_2)  # disabled
merge_10 = Merge(Data1=rotate_plane_4, Data2=move_2.Geometry)  # disabled

# ---- group: HYPOBOLOID GENERATION
number_slider_33 = Slider(35, range=0..90)  # disabled
radius_a_4 = Slider(0.5, range=0..10)  # disabled
radius_b_4 = Slider(0.9, range=0..10)  # disabled
number_slider_34 = Slider(2, range=0..30)  # disabled
rad_4 = Radians(Degrees=number_slider_33)  # disabled
rtrig_4 = RightTrigonometry(Alpha=rad_4, PLength=radius_a_4)  # -> Alpha, Beta, PLength, QLength, RLength; disabled
python_4 = GhPythonScript(a=radius_a_4, b=radius_b_4, c=rtrig_4.QLength, depth=number_slider_34, h=number_slider_34)  # -> out, hyperboloid, hyperbola; disabled; same code as python
cap_4 = CapHoles(Brep=python_4.hyperboloid)  # disabled
hyperboloid___brep_9 = DataDescription(cap_4)  # disabled

# ---- group: HYPOBOLOID GENERATION / Data Description
hyperboloid___brep_10 = Hyperboloid_Srf(hyperboloid___brep_9)  # disabled

# ---- group: Surface Hyperboloids
base_surface_5 = Surface(<surface referenced from the Rhino model>)  # disabled
number_slider_35 = Slider(2.4, range=0..10)  # disabled
panel_5 = Panel("""0
-1""")  # disabled
number_slider_36 = Slider(1.2, range=0..10)  # disabled

# ----
surface_3 = DataDescription(base_surface_5)  # disabled
final_wall_3 = Brep(<brep referenced from the Rhino model>)  # disabled

# ---- group: Surface Hyperboloids (continued)
dimensions_5 = Dimensions(Surface=surface_3)  # -> UDimension, VDimension; disabled
division_9 = Division(A=dimensions_5.UDimension, B=number_slider_35)  # disabled
division_10 = Division(A=dimensions_5.VDimension, B=number_slider_35)  # disabled
round_9 = Round(Number=division_9)  # -> Nearest, Floor, Ceiling; disabled
round_10 = Round(Number=division_10)  # -> Nearest, Floor, Ceiling; disabled
divide_surface_5 = DivideSurface(Surface=surface_3, UCount=round_9.Ceiling, VCount=round_10.Ceiling)  # -> Points, Normals, Parameters; disabled
evaluate_surface_7 = EvaluateSurface(Surface=surface_3, Point=divide_surface_5.Parameters)  # -> Point, Normal, UDirection, VDirection, Frame; disabled
clean_tree_5 = CleanTree(RemoveNulls=True, RemoveInvalid=True, RemoveEmpty=False, Tree=evaluate_surface_7.Frame)  # disabled
tree_statistics_7 = TreeStatistics(Tree=clean_tree_5)  # -> Paths, Length, Count; disabled
flip_matrix_13 = FlipMatrix(Data=clean_tree_5)  # disabled
list_item_9 = ListItem(List=tree_statistics_7.Paths, Index=0, Wrap=invert(True))  # -> Item1, Item; disabled
cull_index_9 = CullIndex(List=flip_matrix_13, Indices=panel_5, Wrap=True)  # disabled
merge_11 = Merge(Data1=list_item_9.Item1, Data2=list_item_9.Item)  # disabled
flip_matrix_14 = FlipMatrix(Data=cull_index_9)  # disabled
cull_index_10 = CullIndex(List=flip_matrix_14, Indices=panel_5, Wrap=True)  # disabled
flip_matrix_15 = FlipMatrix(Data=cull_index_10)  # disabled
plane_15 = Plane(flip_matrix_15)  # disabled
point_list_3 = PointList(Points=plane_15, Size=number_slider_36)  # disabled

# ----
hyperboloid_plane_5 = DataDescription(plane_15)  # disabled

hyperboloid___brep_11 = Hyperboloid_Brep(hyperboloid___brep_8)  # disabled
hyperboloid_plane_6 = HyperboloidPlane(hyperboloid_plane_5)  # disabled
orient_3 = Orient(Geometry=hyperboloid___brep_11, Source=PlaneXY(0, 0, 0), Target=hyperboloid_plane_6)  # -> Geometry, Transform; disabled
oriented_hyperboloids_7 = DataDescription(orient_3.Geometry)  # disabled
oriented_hyperboloids_8 = Geometry(oriented_hyperboloids_7)  # disabled

# ---- group: Boolean Operations
boolean_toggle_3 = BooleanToggle(True)  # disabled
oriented_hyperboloids_9 = OrientedHyperboloids(oriented_hyperboloids_8)  # disabled
solid_wall_3 = Surface(final_wall_3)  # disabled
flatten_3 = FlattenTree(Tree=oriented_hyperboloids_9, Path="{0}")  # disabled
dispatch_11 = Dispatch(List=flatten_3, DispatchPattern=boolean_toggle_3)  # -> ListA, ListB; disabled
sdiff_3 = SolidDifference(BrepsA=solid_wall_3, BrepsB=dispatch_11.ListA)  # disabled
perforated_wall___brep_3 = DataDescription(sdiff_3)  # disabled

# ----
# 1st Iterations
xz_plane = XZPlane(Origin=Point(0, 0, 0))  # disabled
number_slider_37 = Slider(20, range=0..100)  # disabled
rectangle = Rectangle(Plane=xz_plane, XSize=number_slider_37, YSize=number_slider_37, Radius=0)  # -> Rectangle, Length; disabled
surface_4 = Surface(rectangle.Rectangle)  # disabled
number_slider_38 = Slider(8, range=0..10)  # disabled
number_slider_39 = Slider(12, range=0..20)  # disabled
divide_surface_6 = DivideSurface(Surface=surface_4, UCount=number_slider_38, VCount=number_slider_39)  # -> Points, Normals, Parameters; disabled
divide_domain² = DivideDomain²(Domain=surface_4, UCount=number_slider_38, VCount=number_slider_39)  # disabled
evaluate_surface_8 = EvaluateSurface(Surface=surface_4, Point=divide_surface_6.Parameters)  # -> Point, Normal, UDirection, VDirection, Frame; disabled
plane_16 = Plane(evaluate_surface_8.Frame)  # disabled
flip_matrix_16 = FlipMatrix(Data=plane_16)  # disabled
isotrim = Isotrim(Surface=surface_4, Domain=divide_domain²)  # disabled
tree_statistics_8 = TreeStatistics(Tree=flip_matrix_16)  # -> Paths, Length, Count; disabled
dispatch_12 = Dispatch(List=tree_statistics_8.Paths, DispatchPattern=[True, False])  # -> ListA, ListB; disabled
tree_branch_5 = TreeBranch(Tree=flip_matrix_16, Path=dispatch_12.ListA, MaintainPaths=True, SplitTree=False)  # disabled
tree_branch_6 = TreeBranch(Tree=flip_matrix_16, Path=dispatch_12.ListB, MaintainPaths=True, SplitTree=False)  # disabled
plane_17 = Plane(tree_branch_6)  # disabled
plane_18 = Plane(tree_branch_5)  # disabled
dispatch_13 = Dispatch(List=plane_18, DispatchPattern=[True, False])  # -> ListA, ListB; disabled
dispatch_14 = Dispatch(List=plane_17, DispatchPattern=[True, False])  # -> ListA, ListB; disabled
list_b_7 = DataDescription(dispatch_13.ListB)  # disabled
list_a_7 = DataDescription(dispatch_14.ListA)  # disabled
list_a_8 = DataDescription(dispatch_13.ListA)  # disabled
list_b_8 = DataDescription(dispatch_14.ListB)  # disabled
number_slider_40 = Slider(8, range=0..8)  # disabled
weave_5 = Weave(Pattern=[0, 1], Stream0=list_b_7, Stream1=list_a_7, NullGaps=False)  # disabled
weave_6 = Weave(Pattern=[0, 1], Stream0=list_a_8, Stream1=list_b_8, NullGaps=False)  # disabled
list_item_10 = ListItem(List=weave_5, Index=number_slider_40, Wrap=True)  # disabled
list_item_11 = ListItem(List=weave_6, Index=number_slider_40, Wrap=True)  # disabled
line_3 = Line(StartPoint=list_item_10, EndPoint=list_item_11)  # disabled
circle_3 = Circle(Plane=weave_5, Radius=line_3)  # disabled
number_slider_41 = Slider(4, range=0..10)  # disabled
divide_curve_3 = DivideCurve(Curve=circle_3, Count=number_slider_41, Kinks=False)  # -> Points, Tangents, Parameters; disabled
surface_closest_point_3 = SurfaceClosestPoint(Point=divide_curve_3.Points, Surface=surface_4)  # -> Point, UVPoint, Distance; disabled
evaluate_surface_9 = EvaluateSurface(Surface=surface_4, Point=surface_closest_point_3.UVPoint)  # -> Point, Normal, UDirection, VDirection, Frame; disabled
number_slider_42 = Slider(0.17, range=0..1)  # disabled
plane_19 = Plane(evaluate_surface_9.Frame)  # disabled
negative_11 = Negative(Value=number_slider_42)  # disabled
plane_offset_3 = PlaneOffset(BasePlane=plane_19, Offset=negative_11)  # disabled
number_slider_43 = Slider(25, range=0..180)  # disabled
center_3 = Center(Geometric=plane_offset_3)  # -> Center, Dimension; disabled
radians_11 = Radians(Degrees=number_slider_43)  # disabled
deconstruct_plane_5 = DeconstructPlane(Plane=plane_offset_3)  # -> Origin, XAxis, YAxis, ZAxis; disabled
rotate_3d_5 = Rotate3D(Geometry=plane_offset_3, Angle=radians_11, Center=center_3.Center, Axis=deconstruct_plane_5.XAxis)  # -> Geometry, Transform; disabled
dispatch_15 = Dispatch(List=rotate_3d_5.Geometry, DispatchPattern=[True, False])  # -> ListA, ListB; disabled
list_a_9 = DataDescription(dispatch_15.ListA)  # disabled
number_slider_44 = Slider(0.75, range=0..1)  # disabled
list_b_9 = DataDescription(dispatch_15.ListB)  # disabled
number_slider_45 = Slider(45, range=0..180)  # disabled
list_length_3 = ListLength(List=list_a_9)  # disabled
negative_12 = Negative(Value=number_slider_44)  # disabled
radians_12 = Radians(Degrees=number_slider_45)  # disabled
merge_12 = Merge(Data1=number_slider_44, Data2=negative_12)  # disabled
negative_13 = Negative(Value=radians_12)  # disabled
unit_z_3 = UnitZ(Factor=merge_12)  # disabled
merge_13 = Merge(Data1=radians_12, Data2=negative_13)  # disabled
move_3 = Move(Geometry=list_b_9, Motion=unit_z_3)  # -> Geometry, Transform; disabled
repeat_data_3 = RepeatData(Data=merge_13, Length=list_length_3)  # disabled
rotate_plane_5 = RotatePlane(Plane=list_a_9, Angle=repeat_data_3)  # disabled
merge_14 = Merge(Data1=rotate_plane_5, Data2=move_3.Geometry)  # disabled
flatten_tree = FlattenTree(Tree=merge_14, Path="{0}")  # disabled
surface_closest_point_4 = SurfaceClosestPoint(Point=flatten_tree, Surface=surface_4)  # -> Point, UVPoint, Distance; disabled
number_slider_46 = Slider(0.32, range=0..100)  # disabled
cull_duplicates = CullDuplicates(Points=surface_closest_point_4.Point, Tolerance=0.1, CullMode=3)  # -> Points, Indices, Valence; disabled
point_list_4 = PointList(Points=cull_duplicates.Points, Size=number_slider_46)  # disabled

# ---- group: Wall
wall_thickness_x2 = Slider(1.35, range=0..5)  # disabled
boolean_toggle_4 = BooleanToggle(True)  # disabled
negative_14 = Negative(Value=wall_thickness_x2)  # disabled
offset_surface = OffsetSurface(Surface=surface_4, Distance=wall_thickness_x2, BothSides=negative_14, CreateSolid=boolean_toggle_4)  # disabled

# ----
hyperboloid = Hyperboloid()  # disabled
orient_4 = Orient(Geometry=hyperboloid, Source=PlaneXY(0, 0, 0), Target=merge_14)  # -> Geometry, Transform; disabled
wall = Data(offset_surface)  # disabled
solid_difference = SolidDifference(BrepsA=wall, BrepsB=flatten(orient_4.Geometry))  # disabled

point_in_brep = PointInBrep(Brep=offset_surface, Point=cull_duplicates.Points, Strict=False)  # disabled
cull_pattern = CullPattern(List=cull_duplicates.Points, CullPattern=point_in_brep)  # disabled
custom_preview = CustomPreview(
    Geometry=solid_difference,
    Material={diffuse=RGB(221, 160, 221), emission=RGB(66, 48, 66), shine=0.5, specular=RGB(255, 255, 255), transparency=0})  # disabled

toggle = BooleanToggle(True)  # disabled
radius_1 = Slider(25, range=10..25)  # disabled
height = Slider(14, range=10..25)  # disabled
wall_thickness = Slider(2, range=0..2)  # disabled
radius_2 = Slider(18, range=10..25)  # disabled
number_slider_47 = Slider(2.5, range=0..10)  # disabled
offset_plane = Slider(0, range=0..1)  # disabled
srf_trim_0 = Slider(0.447, range=0..1)  # disabled
rotation = Slider(0.354, range=0..1)  # disabled
srf_trim_1 = Slider(0.57, range=0..1)  # disabled
tilt = Slider(0.051, range=0..0.25)  # disabled
number_slider_48 = Slider(0.4, range=0..1)  # disabled
number_slider_49 = Slider(0.5, range=0..1)  # disabled
boolean_toggle_5 = Toggle(toggle)  # disabled
wall_thickness_2 = WallThickness(wall_thickness)  # disabled
wall_thickness_3 = Surface(wall_thickness_2)  # disabled
srf_trim_1_2 = SrfTrim1(srf_trim_1)  # disabled
srf_trim_1_3 = NumberSlider(srf_trim_1_2)  # disabled
boolean_toggle_6 = BooleanToggle(boolean_toggle_5)  # disabled
srf_trim_0_2 = SrfTrim0(srf_trim_0)  # disabled
srf_trim_0_3 = NumberSlider(srf_trim_0_2)  # disabled
r1 = Radius1(radius_1)  # disabled
r1_2 = NumberSlider(r1)  # disabled
h1 = Radius1(height)  # disabled
h1_2 = NumberSlider(h1)  # disabled
r2 = Radius1(radius_2)  # disabled
r2_2 = NumberSlider(r2)  # disabled
offset_plane_2 = OffsetPlane(offset_plane)  # disabled
offset_plane_3 = NumberSlider(offset_plane_2)  # disabled
rotation_2 = Rotation(rotation)  # disabled
rotation_3 = NumberSlider(rotation_2)  # disabled
tilt_2 = Tilt(tilt)  # disabled
tilt_3 = NumberSlider(tilt_2)  # disabled
number_slider_50 = DataDescription(number_slider_47)  # disabled
merge_15 = Merge()  # disabled
brep = Brep([<brep referenced from the Rhino model> x6])  # disabled
brep_join = BrepJoin(Breps=brep)  # -> Breps, Closed; disabled
curve_3 = Curve(<curve referenced from the Rhino model>)  # disabled
curve_4 = Curve(<curve referenced from the Rhino model>)  # disabled
flip_curve = FlipCurve(Curve=curve_3)  # -> Curve, Flag; disabled
ruled_surface_2 = RuledSurface(CurveA=flip_curve.Curve, CurveB=curve_4)  # disabled
taper = Taper(Flat=False, Infinite=False, Rigid=False)  # disabled
surface_5 = DataDescription(ruled_surface_2)  # disabled
brep_2 = Brep(<brep referenced from the Rhino model>)  # disabled
panel_6 = Panel("{0.5,0.5,0}")  # disabled
number_slider_51 = Slider(2, range=0..2)  # disabled
number_slider_52 = Slider(0.6, range=0..1)  # disabled
Y = UnitY(Factor=number_slider_52)  # disabled

# ---- group: BASE SURFACE
yz = YZPlane(Origin=Point(0, 0, 0))  # disabled
X = UnitX(Factor=1)  # disabled
pt = ConstructPoint(XCoordinate=0, YCoordinate=0, ZCoordinate=0)  # disabled
r1_3 = NumberSlider(r1)  # disabled
r2_3 = NumberSlider(r2)  # disabled
h1_3 = NumberSlider(h1)  # disabled
ellipse = Ellipse(Plane=PlaneXY(0, 0, 0), Radius1=r1_3, Radius2=r2_3)  # -> Ellipse, Focus1, Focus2; disabled
ellipse_2 = Ellipse(Plane=yz, Radius1=r2_3, Radius2=h1_3)  # -> Ellipse, Focus1, Focus2; disabled
line_4 = LineSDL(Start=pt, Direction=X, Length=1)  # disabled
railrev = RailRevolution(Curve=ellipse.Ellipse, Rail=ellipse_2.Ellipse, Axis=line_4, Scale=False)  # disabled
srf_trim_1_4 = NumberSlider(srf_trim_1_2)  # disabled
srf_trim_0_4 = NumberSlider(srf_trim_0_2)  # disabled
panel_7 = Panel("0.5")  # disabled
dom²num = ConstructDomain²(UMin=number_slider_48, UMax=number_slider_49, VMin=srf_trim_0_4, VMax=srf_trim_1_4)  # disabled
subsrf = Isotrim(Surface=reparameterize(railrev), Domain=dom²num)  # disabled
panel_8 = Panel("20")  # disabled
rebsrf = RebuildSurface(Surface=subsrf, CountU=panel_8, CountV=panel_8)  # disabled
flip = Flip(Surface=rebsrf)  # -> Surface, Result; disabled
base_surface_6 = DataDescription(flip.Surface)  # disabled
base_surface_7 = Surface(base_surface_6)  # disabled

# ----
surface_6 = Surface(surface_5)  # disabled
dim = Dimensions(Surface=surface_6)  # -> UDimension, VDimension; disabled
number_slider_53 = NumberSlider(number_slider_50)  # disabled
division_11 = Division(A=dim.UDimension, B=number_slider_53)  # disabled
division_12 = Division(A=dim.VDimension, B=number_slider_53)  # disabled
sdivide = DivideSurface(Surface=surface_6, UCount=division_11, VCount=division_12)  # -> Points, Normals, Parameters; disabled
evalsrf = EvaluateSurface(Surface=surface_6, Point=sdivide.Parameters)  # -> Point, Normal, UDirection, VDirection, Frame; disabled
rotation_4 = NumberSlider(rotation_2)  # disabled
offset_plane_4 = NumberSlider(offset_plane_2)  # disabled
neg = Negative(Value=rotation_4)  # disabled
pl_offset = PlaneOffset(BasePlane=evalsrf.Frame, Offset=offset_plane_4)  # disabled
merge_16 = Merge(Data1=rotation_4, Data2=neg)  # disabled
tstat = TreeStatistics(Tree=evalsrf.Frame)  # -> Paths, Length, Count; disabled
pi = Pi(Factor=merge_16)  # disabled
tilt_4 = NumberSlider(tilt_2)  # disabled
repeat = RepeatData(Data=pi, Length=tstat.Length)  # disabled
pi_2 = Pi(Factor=tilt_4)  # disabled
prot = RotatePlane(Plane=pl_offset, Angle=repeat)  # disabled
deplane = DeconstructPlane(Plane=prot)  # -> Origin, XAxis, YAxis, ZAxis; disabled
rot3d = Rotate3D(Geometry=prot, Angle=pi_2, Center=deplane.Origin, Axis=deplane.YAxis)  # -> Geometry, Transform; disabled
hyperboloid___planes = DataDescription(rot3d.Geometry)  # disabled
hyperboloid___planes_2 = Geometry(hyperboloid___planes)  # disabled

surface_7 = Surface(surface_5)  # disabled
dim_2 = Dimensions(Surface=surface_7)  # -> UDimension, VDimension; disabled
number_slider_54 = NumberSlider(number_slider_50)  # disabled
division_13 = Division(A=dim_2.UDimension, B=number_slider_54)  # disabled
division_14 = Division(A=dim_2.VDimension, B=number_slider_54)  # disabled
divide = DivideDomain²(Domain=surface_7, UCount=division_13, VCount=division_14)  # disabled
subsrf_2 = Isotrim(Surface=surface_7, Domain=divide)  # disabled
wires = BrepWireframe(Brep=subsrf_2, Density=-1)  # disabled
join = JoinCurves(Curves=wires, Preserve=False)  # disabled
curves = DataDescription(join)  # disabled

hyperboloid___planes_3 = Geometry(hyperboloid___planes)  # disabled
curves_2 = Curves(curves)  # disabled
disc = Discontinuity(Curve=curves_2, Level=1)  # -> simplify(Points), Parameters; disabled
deplane_2 = DeconstructPlane(Plane=hyperboloid___planes_3)  # -> Origin, XAxis, YAxis, ZAxis; disabled
cp = ClosestPoint(Point=graft(disc.Points), Cloud=flatten(deplane_2.Origin))  # -> ClosestPoint, CPIndex, Distance; disabled
item = ListItem(List=flatten(hyperboloid___planes_3), Index=cp.CPIndex, Wrap=True)  # disabled
trim = TrimTree(Tree=item, Depth=1)  # disabled
wall_thickness_4 = Surface(wall_thickness_2)  # disabled
deplane_3 = DeconstructPlane(Plane=trim)  # -> Origin, XAxis, YAxis, ZAxis; disabled
amp = Amplitude(Vector=deplane_3.ZAxis, Amplitude=wall_thickness_4)  # disabled
expression = Expression(P=deplane_3.Origin, V=amp, Expression="P-(v/2)")  # disabled
line_5 = LineSDL(Start=expression, Direction=amp, Length=amp)  # disabled
panel_9 = Panel("1")  # disabled
divide_2 = DivideCurve(Curve=line_5, Count=panel_9, Kinks=False)  # -> Points, Tangents, Parameters; disabled
path_mapper = PathMapper(divide_2.Points, source="{A;B}[i]", target="{A;i}[B]")  # disabled
flip_last = FlipLast(Data=divide_2.Points)  # disabled
pline = PolyLine(Vertices=path_mapper, Closed=invert(False))  # disabled
item_2 = ListItem(List=path_mapper, Index=0, Wrap=True)  # -> Item, Item1, Item2, Item3; disabled
trim_2 = TrimTree(Tree=pline, Depth=1)  # disabled
srf4pt = _4PointSurface(CornerA=item_2.Item, CornerB=item_2.Item1, CornerC=item_2.Item2, CornerD=item_2.Item3)  # disabled
trim_3 = TrimTree(Tree=srf4pt, Depth=1)  # disabled
loft = Loft(Curves=trim_2, Options={Adjust=False, Closed=False, LoftEnds=0, LoftSimp=0, LoftType=0, Rebuild=10, Refit=0.01})  # disabled
merge_17 = Merge(Data1=loft, Data2=trim_3)  # disabled
join_2 = BrepJoin(Breps=merge_17)  # -> Breps, Closed; disabled
modules___brep = DataDescription(join_2.Breps)  # disabled
modules___brep_2 = Geometry(modules___brep)  # disabled

hyperboloid___planes_4 = Geometry(hyperboloid___planes)  # disabled
hyperboloid___brep_12 = Hyperboloid_Srf(hyperboloid___brep_9)  # disabled
orient_5 = Orient(Geometry=hyperboloid___brep_12, Source=PlaneXY(0, 0, 0), Target=hyperboloid___planes_4)  # -> Geometry, Transform; disabled
oriented_hyperboloids_10 = DataDescription(orient_5.Geometry)  # disabled
oriented_hyperboloids_11 = Geometry(oriented_hyperboloids_10)  # disabled

wall_thickness_5 = Surface(wall_thickness_2)  # disabled
surface_8 = Surface(surface_5)  # disabled
expression_2 = Expression(x=wall_thickness_5, Expression="x/2")  # disabled
offsrf = OffsetSurface(Surface=surface_8, Distance=expression_2, BothSides=expr("-x", expression_2), CreateSolid=True)  # disabled
solid_wall_4 = WallThickness(offsrf)  # disabled
solid_wall_5 = Surface(solid_wall_4)  # disabled

solid_wall_6 = Surface(solid_wall_4)  # disabled
oriented_hyperboloids_12 = Geometry(oriented_hyperboloids_10)  # disabled
flatten_4 = FlattenTree(Tree=oriented_hyperboloids_12, Path="{0}")  # disabled

dispatch_16 = Dispatch(List=flatten_4, DispatchPattern=boolean_toggle_6)  # -> ListA, ListB; disabled

sdiff_4 = SolidDifference(BrepsA=brep_2, BrepsB=dispatch_16.ListA)  # disabled

perforated_wall___brep_4 = DataDescription(sdiff_4)  # disabled
perforated_wall___brep_5 = Result(perforated_wall___brep_4)  # disabled

# ---- group: Atomic subdivision - Voussoir
perforated_wall___brep_6 = Result(perforated_wall___brep_5)  # disabled
hyperboloid___planes_5 = Geometry(hyperboloid___planes)  # disabled
modules___brep_3 = Geometry(modules___brep)  # disabled
number_slider_55 = Slider(0.583, range=0..1)  # disabled
tstat_2 = TreeStatistics(Tree=modules___brep_3)  # -> Paths, Length, Count; disabled
expression_3 = Expression(x=tstat_2.Count, y=number_slider_55, Expression="floor((x-1)*y)")  # disabled
item_3 = ListItem(List=tstat_2.Paths, Index=expression_3, Wrap=True)  # disabled
branch = TreeBranch(Tree=modules___brep_3, Path=item_3, MaintainPaths=True)  # disabled
debrep = DeconstructBrep(Brep=branch)  # -> Faces, Edges, Vertices; disabled
trim_4 = TrimTree(Tree=debrep.Faces, Depth=1)  # disabled
item_4 = ListItem(List=reverse(trim_4), Index=0, Wrap=True)  # -> Item, Item1; disabled
flip_2 = FlipCurve(Curve=item_4.Item1)  # -> Curve, Flag; disabled
crv = Curve(item_4.Item)  # disabled
merge_18 = Merge(Data1=crv, Data2=flip_2.Curve)  # disabled
explode = Explode(Curve=merge_18, Recursive=True)  # -> Segments, Vertices; disabled
item_5 = ListItem(List=explode.Segments, Index=0, Wrap=True)  # -> Item, Item1, Item2, Item3; disabled
edgesrf = EdgeSurface(CurveA=item_5.Item, CurveB=item_5.Item1, CurveC=item_5.Item2, CurveD=item_5.Item3)  # disabled
smesh = SimpleMesh(Brep=edgesrf)  # disabled
panel_10 = Panel("0")  # disabled
wbsplitquads = WeaverbirdsConstantQuadsSplitSubdivision(MeshCurves=smesh, Level=1, SmoothNakedEdges=panel_10)  # disabled
wbfacepolys = WeaverbirdsFacePolylines(Mesh=wbsplitquads)  # disabled
flip_last_2 = FlipLast(Data=wbfacepolys)  # disabled
explode_2 = Explode(Curve=flip_last_2, Recursive=True)  # -> Segments, Vertices; disabled
loft_2 = Loft(Curves=flip_last_2, Options={Adjust=False, Closed=False, LoftEnds=0, LoftSimp=0, LoftType=0, Rebuild=10, Refit=0.01})  # disabled
item_6 = ListItem(List=explode_2.Segments, Index=0, Wrap=True)  # -> Item, Item1, Item2, Item3; disabled
edgesrf_2 = EdgeSurface(CurveA=item_6.Item, CurveB=item_6.Item1, CurveC=item_6.Item2, CurveD=item_6.Item3)  # disabled
trim_5 = TrimTree(Tree=edgesrf_2, Depth=1)  # disabled
merge_19 = Merge(Data1=trim_5, Data2=loft_2)  # disabled
hyperboloid___planes_6 = Hyperboloid_Planes(flatten(hyperboloid___planes_5))  # disabled
deplane_4 = DeconstructPlane(Plane=hyperboloid___planes_6)  # -> Origin, XAxis, YAxis, ZAxis; disabled
join_3 = BrepJoin(Breps=merge_19)  # -> Breps, Closed; disabled
brepinc = PointInBrep(Brep=join_3.Breps, Point=deplane_4.Origin, Strict=False)  # disabled
cull = CullPattern(List=hyperboloid___planes_6, CullPattern=brepinc)  # disabled
sec = BrepPlane(Brep=join_3.Breps, Plane=cull)  # -> Curves, Points; disabled
explode_3 = Explode(Curve=sec.Curves, Recursive=True)  # -> Segments, Vertices; disabled
item_7 = ListItem(List=explode_3.Segments, Index=0, Wrap=True)  # -> Item, Item1, Item2, Item3; disabled
edgesrf_3 = EdgeSurface(CurveA=item_7.Item, CurveB=item_7.Item1, CurveC=item_7.Item2, CurveD=item_7.Item3)  # disabled
split = SplitBrep(Brep=join_3.Breps, Cutter=edgesrf_3)  # disabled
trim_6 = TrimTree(Tree=split, Depth=1)  # disabled
perforated_wall___brep_7 = PerforatedWall_Brep(perforated_wall___brep_6)  # disabled
cap_5 = CapHoles(Brep=trim_6)  # -> graft(Brep); disabled
sint = SolidIntersection(BrepsA=perforated_wall___brep_7, BrepsB=cap_5)  # disabled
voussoir = DataDescription(sint)  # disabled
voussoir_2 = Result(voussoir)  # disabled

# ----
crv_2 = Curve(sec.Curves)  # disabled
boundary = BoundarySurfaces(Edges=crv_2)  # disabled
evalsrf_2 = EvaluateSurface(Surface=reparameterize(boundary), Point=panel_6)  # -> Point, Normal, UDirection, VDirection, Frame; disabled
voussoir_3 = Result(voussoir)  # disabled
deplane_5 = DeconstructPlane(Plane=evalsrf_2.Frame)  # -> Origin, XAxis, YAxis, ZAxis; disabled
neg_2 = Negative(Value=deplane_5.ZAxis)  # disabled
padjust = AdjustPlane(Plane=evalsrf_2.Frame, Normal=neg_2)  # disabled
merge_20 = Merge(Data1=evalsrf_2.Frame, Data2=padjust)  # disabled
trim_7 = TrimTree(Tree=voussoir_3, Depth=1)  # disabled
trim_8 = TrimTree(Tree=merge_20, Depth=1)  # disabled
tstat_3 = TreeStatistics(Tree=trim_8)  # -> Paths, Length, Count; disabled
series = Series(Start=0, Step=number_slider_51, Count=tstat_3.Count)  # disabled
series_2 = Series(Start=0, Step=number_slider_51, Count=tstat_3.Length)  # disabled
pt_2 = ConstructPoint(XCoordinate=graft(series), YCoordinate=series_2, ZCoordinate=0)  # disabled
graft = GraftTree(Tree=trim_7, IncludeEmptyLists=True, IncludeNullItems=True)  # disabled
tstat_4 = TreeStatistics(Tree=graft)  # -> Paths, Length, Count; disabled
dpath = DeconstructPath(Branch=tstat_4.Paths)  # disabled
item_8 = ListItem(List=dpath, Index=0, Wrap=True)  # -> Item1, Item, Item1_2; disabled
merge_21 = Merge(Data1=item_8.Item, Data2=item_8.Item1_2, Data3=item_8.Item1)  # disabled
path = ConstructPath(Indices=merge_21)  # disabled
move_4 = Move(Geometry=pt_2, Motion=Y)  # -> Geometry, Transform; disabled
orient_6 = Orient(Geometry=trim_7, Source=merge_20, Target=move_4.Geometry)  # -> Geometry, Transform; disabled
tag = TextTag3D(Location=graft(pt_2), Text=path, Size=0.1, Justification=5)  # disabled
