# Grasshopper definition 2023.03.05_Solved Surface Grids.gh (Grasshopper 1.0.8)
# plug-ins: Heteroptera, treesloth01, Pufferfish, HFTidyCanvas

number_slider = Slider(1, range=0..30)
rad = Radians(Degrees=Slider(15.81, range=0..90))
radius_a = Slider(0.2, range=0..10)
rad_2 = Radians(Degrees=Slider(15.14, range=0..90))
rtrig = RightTrigonometry(Alpha=rad_2, PLength=rad)  # -> Alpha, Beta, PLength, QLength, RLength
python = GhPythonScript(a=radius_a, b=radius_a, c=rtrig.QLength, depth=number_slider, h=number_slider)  # -> out, hyperboloid, hyperbola
# ---------- python: Python ----------
__author__ = "ashkan"
__version__ = "2021.03.29"

import rhinoscriptsyntax as rs
import scriptcontext
import math

def get_hyperbola(a, c, h) :
    """
    Draws a hyperbola on the XZ plane, centred at 0,0,0.
    """
    
    p0 = [0,0,0]
    p1 = [0,0,0]
    p2 = [0,0,0]
    q = [0,0,0]

    p0[0] = math.sqrt(a**2 * (1 + (h**2 / c**2)))
    p0[2] = h

    p1[0] = (-1 * p0[2]**2 * a**2) / (c**2 * p0[0]) + p0[0]
    p1[2] = 0

    p2[0] = p0[0]
    p2[2] = -h

    q[0] = a
    q[2] = 0

    w1 = (p0[0]-q[0]) / (q[0]-p1[0])

    points = [rs.AddPoint(p0), rs.AddPoint(p1), rs.AddPoint(p2)]
    knots = [0,0,1,1]
    weights = [1,w1,1]
    
    hyperbola = rs.AddNurbsCurve(points,knots,2,weights)
    print(rs.CurveWeights(hyperbola))


    return hyperbola

def get_hyperboloid(a, b, c, depth) :
    hyperbola = get_hyperbola(a, c, depth)   
    axis = rs.AddLine(rs.AddPoint(0,0,0),rs.AddPoint(0,0,1))
    hyperboloid = rs.AddRevSrf(hyperbola,axis)
    
    y_factor = float(b) / float(a)
    hyperboloid = rs.ScaleObject(hyperboloid, rs.AddPoint(0,0,0), [1,y_factor,1])
    return hyperboloid
    
hyperboloid = get_hyperboloid(a, b, c, depth)
hyperbola = get_hyperbola (a,c,h)
# ---------- end python ----------
cap = CapHoles(Brep=python.hyperboloid)

number_slider_2 = Slider(0.7, range=0..30)
rad_3 = Radians(Degrees=Slider(8.55, range=0..90))
radius_a_2 = Slider(0.1, range=0..10)
rad_4 = Radians(Degrees=Slider(20.12, range=0..90))
rtrig_2 = RightTrigonometry(Alpha=rad_4, PLength=rad_3)  # -> Alpha, Beta, PLength, QLength, RLength
python_2 = GhPythonScript(a=radius_a_2, b=radius_a_2, c=rtrig_2.QLength, depth=number_slider_2, h=number_slider_2)  # -> out, hyperboloid, hyperbola; same code as python
cap_2 = CapHoles(Brep=python_2.hyperboloid)

# ----
# After Gaudi
# Wall Grid
brep = Brep(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)
brep_2 = Brep(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)
brep_3 = Brep(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)
deconstruct_brep = DeconstructBrep(Brep=brep)  # -> Faces, Edges, Vertices
base_surface = Surface(reparameterize(brep_2))
list_item = ListItem(List=deconstruct_brep.Edges, Index=0, Wrap=True)  # -> Item, Item1, Item2
dimensions = Dimensions(Surface=base_surface)  # -> UDimension, VDimension
curve_middle = CurveMiddle(Curve=list_item.Item)
curve_middle_2 = CurveMiddle(Curve=list_item.Item2)
line = Line(StartPoint=curve_middle, EndPoint=curve_middle_2)
division = Division(A=dimensions.UDimension, B=Slider(1.4, range=0..10))
division_2 = Division(A=dimensions.VDimension, B=Slider(1.6, range=0..10))
evaluate_curve = EvaluateCurve(Curve=reparameterize(line), Parameter=Slider(0.54, range=0..1))  # -> Point, Tangent, Angle
round = Round(Number=division)  # -> Nearest, Floor, Ceiling
round_2 = Round(Number=division_2)  # -> Nearest, Floor, Ceiling
divide_surface = DivideSurface(Surface=reparameterize(base_surface), UCount=round.Ceiling, VCount=round_2.Ceiling)  # -> Points, Normals, Parameters
evaluate_surface = EvaluateSurface(Surface=reparameterize(base_surface), Point=divide_surface.Parameters)  # -> Point, Normal, UDirection, VDirection, Frame
pull_point = PullPoint(Point=evaluate_surface.Point, Geometry=line, ClosestOnly=True)  # -> ClosestPoint, Distance, Index
line_2 = Line(StartPoint=evaluate_surface.Frame, EndPoint=pull_point.ClosestPoint)
vector_2pt = Vector2Pt(PointA=evaluate_curve.Point, PointB=pull_point.ClosestPoint, Unitize=False)  # -> Vector, Length
vector = Vector(line_2)
bounds = Bounds(Numbers=flatten(pull_point.Distance))
construct_domain = ConstructDomain(DomainStart=Slider(0, range=0..5), DomainEnd=Slider(0.14, range=0..5))
# 1st Iterations
vector_display = VectorDisplay(Anchor=evaluate_surface.Point, Vector=vector_2pt.Vector)
remap_numbers = RemapNumbers(Value=pull_point.Distance, Source=bounds, Target=construct_domain)  # -> Mapped, Clipped
amplitude = Amplitude(Vector=vector, Amplitude=remap_numbers.Mapped)
move = Move(Geometry=divide_surface.Parameters, Motion=amplitude)  # -> Geometry, Transform
plane = Plane(move.Geometry)
evaluate_surface_2 = EvaluateSurface(Surface=reparameterize(base_surface), Point=plane)  # -> Point, Normal, UDirection, VDirection, Frame
panel = Panel(evaluate_surface_2.Frame)
frame = DataDescription(evaluate_surface_2.Frame)
clean_tree = CleanTree(RemoveNulls=True, RemoveInvalid=True, RemoveEmpty=False, Tree=evaluate_surface_2.Frame)
tree_statistics = TreeStatistics(Tree=clean_tree)  # -> Paths, Length, Count
flip_matrix = FlipMatrix(Data=clean_tree)
panel_2 = Panel("""0
-1""")
list_item_2 = ListItem(List=tree_statistics.Paths, Index=0, Wrap=invert(True))  # -> Item1, Item
cull_index = CullIndex(List=flip_matrix, Indices=panel_2, Wrap=True)
flip_matrix_2 = FlipMatrix(Data=cull_index)
merge = Merge(Data1=list_item_2.Item1, Data2=list_item_2.Item)
cull_index_2 = CullIndex(List=flip_matrix_2, Indices="-1", Wrap=True)
plane_2 = Plane(cull_index_2)
flip_matrix_3 = FlipMatrix(Data=plane_2)
plane_3 = Plane(flip_matrix_3)
radians = Radians(Degrees=Slider(20, range=0..360))
rotate_plane = RotatePlane(Plane=plane_3, Angle=radians)
number_slider_3 = Slider(25, range=0..180)
radians_2 = Radians(Degrees=Slider(13, range=0..180))
center = Center(Geometric=rotate_plane)  # -> Center, Dimension
deconstruct_plane = DeconstructPlane(Plane=rotate_plane)  # -> Origin, XAxis, YAxis, ZAxis
negative = Negative(Value=radians_2)
rotate_3d = Rotate3D(Geometry=rotate_plane, Angle=negative, Center=center.Center, Axis=deconstruct_plane.YAxis)  # -> Geometry, Transform
dispatch = Dispatch(List=rotate_3d.Geometry, DispatchPattern=[True, False])  # -> ListA, ListB
list_a = DataDescription(dispatch.ListA)
list_b = DataDescription(dispatch.ListB)
list_length = ListLength(List=list_a)
radians_3 = Radians(Degrees=Slider(0, range=0..180))
merge_2 = Merge(Data1=Slider(0.45, range=0..1))
negative_2 = Negative(Value=radians_3)
unit_z = UnitZ(Factor=merge_2)
merge_3 = Merge(Data1=radians_3, Data2=negative_2)
move_2 = Move(Geometry=list_b, Motion=unit_z)  # -> Geometry, Transform
repeat_data = RepeatData(Data=merge_3, Length=list_length)
surface_closest_point = SurfaceClosestPoint(Point=move_2.Geometry, Surface=reparameterize(brep_3))  # -> Point, UVPoint, Distance
evaluate_surface_3 = EvaluateSurface(Surface=reparameterize(brep_3), Point=surface_closest_point.UVPoint)  # -> Point, Normal, UDirection, VDirection, Frame
rotate_plane_2 = RotatePlane(Plane=list_a, Angle=repeat_data)
number_slider_4 = Slider(0.6, range=0..30)
number_slider_5 = Slider(0.6, range=0..30)
tree_statistics_2 = TreeStatistics(Tree=rotate_plane_2)  # -> Paths, Length, Count
merge_4 = Merge(Data1=rotate_plane_2, Data2=evaluate_surface_3.Frame)  # -> flatten(Result)
rad_5 = Radians(Degrees=Slider(21.9, range=0..90))
rad_6 = Radians(Degrees=Slider(8.55, range=0..90))
radius_a_3 = Slider(0.2, range=0..10)
radius_a_4 = Slider(0.1, range=0..10)
tree_statistics_3 = TreeStatistics(Tree=evaluate_surface_3.Frame)  # -> Paths, Length, Count
list_item_3 = ListItem(List=tree_statistics_2.Paths, Index=Slider(0, range=0..7), Wrap=invert(True))
rad_7 = Radians(Degrees=Slider(15.14, range=0..90))
rad_8 = Radians(Degrees=Slider(20.12, range=0..90))
rtrig_3 = RightTrigonometry(Alpha=rad_7, PLength=rad_5)  # -> Alpha, Beta, PLength, QLength, RLength
rtrig_4 = RightTrigonometry(Alpha=rad_8, PLength=rad_6)  # -> Alpha, Beta, PLength, QLength, RLength
list_item_4 = ListItem(List=tree_statistics_3.Paths, Index=Slider(0, range=0..7), Wrap=invert(True))
list_item_5 = ListItem(List=merge_4, Index=Slider(4, range=0..30), Wrap=invert(True))
tree_branch = TreeBranch(Tree=rotate_plane_2, Path=list_item_3, MaintainPaths=True)
partition_list = PartitionList(List=merge_4, Size="5")
tree_branch_2 = TreeBranch(Tree=evaluate_surface_3.Frame, Path=list_item_4, MaintainPaths=True)
list_length_2 = ListLength(List=tree_branch)
point_list = PointList(Points=merge_4, Size=Slider(0.87, range=0..10))
python_3 = GhPythonScript(a=radius_a_3, b=radius_a_3, c=rtrig_3.QLength, depth=number_slider_4, h=number_slider_4)  # -> out, hyperboloid, hyperbola; same code as python
python_4 = GhPythonScript(a=radius_a_4, b=radius_a_4, c=rtrig_4.QLength, depth=number_slider_5, h=number_slider_5)  # -> out, hyperboloid, hyperbola; same code as python
tree_statistics_4 = TreeStatistics(Tree=partition_list)  # -> Paths, Length, Count
repeat_data_2 = RepeatData(Data=cap, Length=list_length_2)
list_length_3 = ListLength(List=tree_branch_2)
repeat_data_3 = RepeatData(Data=cap_2, Length=list_length_3)
panel_3 = Panel("""0
0
0
0
0
1
1
1""")
cap_3 = CapHoles(Brep=python_3.hyperboloid)
cap_4 = CapHoles(Brep=python_4.hyperboloid)
list_item_6 = ListItem(List=tree_statistics_4.Paths, Index=Slider(0, range=0..7), Wrap=invert(True))
list_item_7 = ListItem(List=tree_statistics_4.Paths, Index=Slider(7, range=0..7), Wrap=invert(True))
divide_branches = DivideBranches(DataTree=partition_list, DivisionPattern=panel_3, RenumberPaths=False)  # -> Data0, Data1
tree_branch_3 = TreeBranch(Tree=partition_list, Path=list_item_6, MaintainPaths=True)
repeat_data_4 = RepeatData(Data=cap_3, Length=list_length_2)
repeat_data_5 = RepeatData(Data=cap_4, Length=list_length_3)
data_0_5 = DataDescription(divide_branches.Data0)
data_1_3 = DataDescription(divide_branches.Data1)
hyperbola = Merge(Data1=repeat_data_4, Data2=repeat_data_5)  # -> flatten(Result)
hyperbola_2 = Merge(Data1=repeat_data_2, Data2=repeat_data_3)  # -> flatten(Result)
planes = Merge(Data1=tree_branch, Data2=tree_branch_2)
planes_2 = Merge(Data1=data_0_5, Data2=data_1_3)
tree_statistics_5 = TreeStatistics(Tree=planes_2)  # -> Paths, Length, Count
series = Series(Start=0, Step=1, Count=10)
list_item_8 = ListItem(List=tree_statistics_5.Paths, Index="-1", Wrap=True)
tree_item = TreeItem(Tree=planes_2, Path=list_item_8, Index=series, Wrap=True)
tree_statistics_6 = TreeStatistics(Tree=tree_item)  # -> Paths, Length, Count
tree_branch_4 = TreeBranch(MaintainPaths=True)
hyperboloid___brep_2 = Hyperboloid_Brep_2()
data_1_3_2 = Data13(data_1_3)
hyperboloid___brep_2_2 = Hyperboloid_Brep_1(hyperbola)
data_1_3_3 = Data13(data_1_3)
orient = Orient(Geometry=hyperboloid___brep_2_2, Source=PlaneXY(0, 0, 0), Target=data_1_3_3)  # -> Geometry, Transform
oriented_hyperboloids = DataDescription(orient.Geometry)
oriented_hyperboloids_2 = Geometry(oriented_hyperboloids)
division_3 = Division(A=Slider(0.601, range=0..2), B=2)
negative_3 = Negative(Value=division_3)
offset_surface = OffsetSurface(Surface=brep_3, Distance=division_3, BothSides=negative_3, CreateSolid=True)

data_0_5_2 = Data05(data_0_5)
hyperboloid___brep_2_3 = Hyperboloid_Brep_2(hyperbola_2)
brep_4 = Brep(<brep referenced from the Rhino model>)

hyperboloid___brep_2_4 = Hyperboloid_Brep_1(hyperboloid___brep_2_3)
data_0_5_3 = Frame(data_0_5_2)
orient_2 = Orient(Geometry=hyperboloid___brep_2_4, Source=PlaneXY(0, 0, 0), Target=data_0_5_3)  # -> Geometry, Transform
oriented_hyperboloids_3 = DataDescription(orient_2.Geometry)
oriented_hyperboloids_4 = Geometry(oriented_hyperboloids_3)

merge_5 = Merge(Data1=oriented_hyperboloids_3, Data2=oriented_hyperboloids)  # -> flatten(Result)
flatten_tree = FlattenTree(Tree=merge_5, Path="{0}")
solid_intersection = SolidIntersection(BrepsA=flatten_tree, BrepsB=offset_surface)

oriented_hyperboloids_5 = OrientedHyperboloids(merge_5)
solid_wall = SolidWall()
flatten = FlattenTree(Tree=oriented_hyperboloids_5, Path="{0}")
dispatch_2 = Dispatch(List=flatten, DispatchPattern=Toggle(True))  # -> ListA, ListB
sdiff = SolidDifference(BrepsA=solid_wall, BrepsB=dispatch_2.ListA)
perforated_wall___brep = DataDescription(sdiff)

oriented_hyperboloids_6 = OrientedHyperboloids(oriented_hyperboloids_2)
perforated_wall___brep_2 = PerforatedWall_Brep(perforated_wall___brep)
flatten_2 = FlattenTree(Tree=oriented_hyperboloids_6, Path="{0}")
dispatch_3 = Dispatch(List=flatten_2, DispatchPattern=Toggle(False))  # -> ListA, ListB
sdiff_2 = SolidDifference(BrepsA=perforated_wall___brep_2, BrepsB=dispatch_3.ListA)
perforated_wall___brep_3 = DataDescription(sdiff_2)

custom_preview = CustomPreview(Geometry=sdiff, Material=ColourSwatch(SwatchColor=RGB(255, 255, 255)))
