# Grasshopper definition CapeTown_Wall Radiance.gh (Grasshopper 1.0.7)
# plug-ins: HFTidyCanvas, Pufferfish, Heteroptera, Bifocals

brep = Brep(<brep referenced from the Rhino model>)
perforated_wall___brep = Result(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)
perforated_wall___brep_2 = Result(brep)
panel = Panel("https://energyplus-weather.s3.amazonaws.com/africa_wmo_region_1/ZAF/ZAF_Cape.Town.688160_IWEC/ZAF_Cape.Town.688160_IWEC.zip")

# ---- group: SUN RENDERING / Local or UTC time
list = ValueList({"Local": "local", "Utc": "utc"}, selected="Local")

# ----
path_mapper = PathMapper()
brec = BoundingRectangle(Geometry=flatten(perforated_wall___brep_2), Plane=PlaneXY(0, 0, 0), Axis=0, Slide=0, Union=True)  # -> Bounding, DimensionX, DimensionY
number_slider = Slider(13, range=0..20)
arrrec = RectangularArray(Geometry=perforated_wall___brep_2, Cell=brec.Bounding, XCount=Slider(1, range=1..10), YCount=Slider(1, range=1..10))  # -> Geometry, Transform
brec_2 = BoundingRectangle(Geometry=flatten(arrrec.Geometry), Plane=PlaneXY(0, 0, 0), Axis=0, Slide=0, Union=True)  # -> Bounding, DimensionX, DimensionY
center = Center(Geometry=brec_2.Bounding)  # -> Center, Dimension
number_slider_2 = Slider(3, range=0..10)
preview = CustomPreview(Geometry=arrrec.Geometry, Material=ColourSwatch(SwatchColor=RGB(176, 105, 72)))  # disabled
range = Range(Domain=Domain(0, 1), Steps=expr("x-1", number_slider))
gradient = Gradient(LowerLimit=0, UpperLimit=1, Parameter=range, stops=[0: RGB(0, 0, 0), 1: RGB(255, 255, 255)])
number_slider_3 = Slider(0.1, range=0..10)
legendpar = LBLegendParameters(seg_count=number_slider, colors=gradient)  # -> leg_par; plug-in component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
mesh = Mesh(arrrec.Geometry)

explode = Explode(Curve=brec_2.Bounding, Recursive=True)  # -> Segments, Vertices
center_2 = Center(Geometry=explode.Segments)  # -> Center, Dimension

# ---- group: SUN RENDERING
number_slider_4 = Slider(4, range=0..24)
expression = Expression(t1=number_slider_4, t2=Slider(15, range=0..24), t=Slider(0.3213, range=0..1), Expression="(t2-t1)*(t*60)")
expression_2 = Expression(x=expression, y=number_slider_4, Expression="floor(x/60)+y")
expression_3 = Expression(x=expression, Expression="x%60")
panel_2 = Panel(expression_2)
month = Slider(6, range=1..12)
second = Slider(59, range=0..59)
minute = Slider(59, range=0..59)
year = Slider(2022, range=2000..2050)
day = Slider(21, range=1..31)
c_script = CSharpScript(year=year, month=month, day=day, hour=expression_2, minute=expression_3, second=second, Time=list)  # -> out, A; inputs year: Int32, month: Int32, day: Int32, hour: Int32, minute: Int32, second: Int32, Time: String
# ---------- c_script: C# ----------
    DateTimeKind dtk = DateTimeKind.Unspecified;
    if(Time == "local"){dtk = DateTimeKind.Local;} else if(Time == "utc"){dtk = DateTimeKind.Utc;}
    DateTime date = new DateTime(year, month, day, hour, minute, second, dtk);

    A = date;
# ---------- end c_script ----------

# ----
panel_3 = Panel(panel)
downloadepw = LBDownloadWeather(weather_URL=panel_3)  # -> epw_file, stat_file, ddy_file; plug-in component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
panel_4 = Panel("""7
8
9
10
11
12
13
14
15
16
17""")
importepw = LBImportEPW(epw_file=downloadepw.epw_file)  # -> location, dry_bulb_temperature, dew_point_temperature, relative_humidity, wind_speed, wind_direction, direct_normal_rad, diffuse_horizontal_rad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; plug-in component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
panel_5 = Panel("21")
panel_6 = Panel("6")
hoy = LBCalculateHOY(month=month, day=day, hour=panel_4)  # -> flatten(hoy), flatten(doy), flatten(date); plug-in component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
sunpath = LBSunPath(location=importepw.location, hoys=flatten(hoy.hoy), center_pt=center.Center, scale=0.5)  # -> report, vectors, altitudes, azimuths, hoys, sun_pts, analemma, daily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; plug-in component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
location = DataDescription(importepw.location)
vectors = DataDescription(sunpath.vectors)

pdecon = Deconstruct(Point=center_2.Center)  # -> XComponent, YComponent, ZComponent
sort = SortList(Keys=pdecon.YComponent, ValuesA=center_2.Center)  # -> Keys, ValuesA
item = ListItem(List=sort.ValuesA, Index=0, Wrap=True)
scale_nu = ScaleNU(Geometry=brec_2.Bounding, Plane=item, ScaleX=Slider(3, range=0..10), ScaleY=Slider(4.56, range=0..10), ScaleZ=1)  # -> Geometry, Transform
boundary = BoundarySurfaces(Edges=scale_nu.Geometry)
dim = Dimensions(Surface=boundary)  # -> UDimension, VDimension
division = Division(A=dim.UDimension, B=number_slider_3)
division_2 = Division(A=dim.VDimension, B=number_slider_3)
mplane = MeshPlane(Boundary=boundary, WidthCount=division_2, HeightCount=division)  # -> Mesh, Area
vectors_2 = Vectors(vectors)
directsunhours = LBDirectSunHours(
    vectors=flatten(vectors_2),
    geometry=flatten([mplane.Mesh, mesh]),
    context=flatten(mesh),
    grid_size="1",
    offset_dist="0.1",
    run=Toggle(True))  # -> report, points, results, mesh, legend, title, int_mtx; plug-in component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

# ---- group: SUN RENDERING (continued)
location_2 = Vectors(location)
decnstrloc = LBDeconstructLocation(location=location_2)  # -> name, latitude, longitude, time_zone, elevation; plug-in component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
c_script_2 = CSharpScript(date=c_script.A, lat=decnstrloc.latitude, lon=decnstrloc.longitude)  # -> out, A; inputs lat: Double, lon: Double
# ---------- c_script_2: C# ----------
    Rhino.Render.Sun s = doc.Lights.Sun;
    s.SetPosition(date, lat, lon);
# ---------- end c_script_2 ----------

# ----
bnd = Bounds(Numbers=directsunhours.results)
dedomain = DeconstructDomain(Domain=bnd)  # -> Start, End
panel_7 = Panel(directsunhours.results)
dom = ConstructDomain(DomainStart=Slider(10, range=0..20), DomainEnd=dedomain.End)
inc = Includes(Value=directsunhours.results, Domain=dom)  # -> Includes, Deviation
cullf = CullFaces(Mesh=directsunhours.mesh, Pattern=inc.Includes)
brec_3 = BoundingRectangle(Geometry=cullf, Plane=PlaneXY(0, 0, 0), Axis=0, Slide=0, Union=True)  # -> Bounding, DimensionX, DimensionY
area = Area(Geometry=cullf)  # -> Area, Centroid
area_2 = Area(Geometry=brec_3.Bounding)  # -> Area, Centroid
expression_4 = Expression(x=area_2.Area, y=area.Area, Expression="(y/x)*100")
panel_8 = Panel(expression_4)
