# Grasshopper definition Find Parallel Vectors.gh (Grasshopper 1.0.8)
# plug-ins: Heteroptera

# ----
# Find Similar Vectors
building_mesh = Data()
Z = UnitZ(Factor=1)
facen = FaceNormals(Mesh=building_mesh)  # -> Centers, Normals
pdecon = Deconstruct(Point=facen.Centers)  # -> XComponent, YComponent, ZComponent
extremums = MinMax(Number=pdecon.ZComponent)  # -> Minimum, Maximum
dprod = DotProduct(VectorA=facen.Normals, VectorB=Z, Unitize=invert(False))
similar = Similarity(FirstNumber=pdecon.ZComponent, SecondNumber=extremums.Maximum, Threshold=0.1)  # -> Similarity, AbsoluteDifference
larger = LargerThan(FirstNumber=dprod, SecondNumber=0)  # -> LargerThan, OrEqualTo
not = GateNot(A=similar.Similarity)
and = GateAnd(A=larger.LargerThan, B=not)
cullf = CullFaces(Mesh=building_mesh, Pattern=invert(and))
