# Grasshopper definition Group Similar Values into a Branch.gh (Grasshopper 1.0.8)
# plug-ins: Parakeet

# Grouping similar values to Tree with Branches
values = Number()

custom_round = CustomRound(Numbers=values, Scope=Slider(50, range=0..100))
cset = CreateSet(List=custom_round)  # -> Set, Map
cset_2 = CreateSet(List=cset.Map)  # -> Set, Map
mindex = MemberIndex(Set=cset.Map, Member=cset_2.Set)  # -> Index, Count
item = ListItem(List=values, Index=mindex.Index, Wrap=True)
