# Grasshopper definition Intuitive hyperboloid.gh (Grasshopper 1.0.7)
# plug-ins: Bifocals, HFTidyCanvas

height = Slider(2.5, range=0..2.5)
hyperboloid_radius_2 = Slider(1.19, range=0..3)
hyperboloid_radius_3 = Slider(1.742, range=0..3)
hyperboloid_radius_1 = Slider(0.869, range=0..1)
xy = XYPlane(Origin=Point(0, 0, 0))
pln = Plane(xy)
neg = Negative(Value=height)
# HOW TO DRAW A HYPERBOLOID: https://www.danieldavis.com/how-to-draw-a-hyperboloid/
pl_offset = PlaneOffset(BasePlane=pln, Offset=[height, neg])
cir = Circle(Plane=pln, Radius=hyperboloid_radius_1)
eval = EvaluateCurve(Curve=reparameterize(cir), Parameter="0")  # -> Point, Tangent, Angle
deplane = DeconstructPlane(Plane=pln)  # -> Origin, XAxis, YAxis, ZAxis
cir_2 = Circle(Plane=pl_offset, Radius=[hyperboloid_radius_2, hyperboloid_radius_3])
pl = ConstructPlane(Origin=eval.Point, XAxis=eval.Tangent, YAxis=deplane.ZAxis)
pcx = CurvePlane(Curve=cir_2, Plane=pl)  # -> simplify(Points), ParamsC, ParamsP
tstat = TreeStatistics(Tree=pcx.Points)  # -> Paths, Length, Count
item = ListItem(List=tstat.Paths, Index=0, Wrap=True)
split = SplitTree(Data=pcx.Points, Masks=flatten(item))  # -> Positive, reverse(Negative)
panel = Panel(item)
merge = Merge(Data1=split.Positive, Data2=split.Negative)
flip = FlipMatrix(Data=merge)
pline = PolyLine(Vertices=flip, Closed=False)
pline_2 = PolyLine(Vertices=pl_offset, Closed=False)
revsrf = Revolution(Curve=pline, Axis=pline_2, Domain=Domain(0, 6.283185307))  # -> flatten(Surface)
item_2 = ListItem(List=revsrf, Index=0, Wrap=True)  # -> Item, Item1
negative_direction_hypar = DataDescription(item_2.Item1)
positive_direction_hypar = DataDescription(item_2.Item)
number_slider = Slider(3.5, range=0..10)
number_slider_2 = Slider(1.5, range=0..10)
positive_direction_hypar_2 = PositiveDirectionHypar(positive_direction_hypar)
negative_direction_hypar_2 = NegativeDirectionHypar(negative_direction_hypar)
scale_nu = ScaleNU(Geometry=negative_direction_hypar_2, Plane=PlaneXY(0, 0, 0), ScaleX=number_slider_2, ScaleY=number_slider, ScaleZ=1)  # -> Geometry, Transform
scale_nu_2 = ScaleNU(Geometry=positive_direction_hypar_2, Plane=PlaneXY(0, 0, 0), ScaleX=number_slider_2, ScaleY=number_slider, ScaleZ=1)  # -> Geometry, Transform
positive_direction_hypar_3 = PositiveDirectionHypar(positive_direction_hypar)

# ---- group: Data Description
negative_direction_hypar_3 = NegativeDirectionHypar(negative_direction_hypar)

# ----
positive_direction_hypar_4 = PositiveDirectionHypar(scale_nu_2.Geometry)

# ---- group: Data Description
negative_direction_hypar_4 = NegativeDirectionHypar(scale_nu.Geometry)

positive_direction_hypar_5 = PositiveDirectionHypar(scale_nu_2.Geometry)

# ----
xz = XZPlane(Origin=Point(0, 0, 0))
sec = BrepPlane(Brep=positive_direction_hypar_5, Plane=xz)  # -> Curves, Points
popgeo = PopulateGeometry(Geometry=positive_direction_hypar_3, Count=Slider(1, range=0..10), Seed=1)
popgeo_2 = PopulateGeometry(Geometry=positive_direction_hypar_4, Count=Slider(1, range=0..10), Seed=1)
preview = CustomPreview(Geometry=sec.Curves, Material=ColourSwatch(SwatchColor=RGB(255, 255, 255)))
preview_2 = CustomPreview(Geometry=positive_direction_hypar_5, Material=ColourSwatch(SwatchColor=RGBA(135, 135, 135, 117)))
srf_cp = SurfaceClosestPoint(Point=popgeo, Surface=negative_direction_hypar_3)  # -> Point, UVPoint, Distance
srf_cp_2 = SurfaceClosestPoint(Point=popgeo, Surface=positive_direction_hypar_3)  # -> Point, UVPoint, Distance
srf_cp_3 = SurfaceClosestPoint(Point=popgeo_2, Surface=negative_direction_hypar_4)  # -> Point, UVPoint, Distance
srf_cp_4 = SurfaceClosestPoint(Point=popgeo_2, Surface=positive_direction_hypar_4)  # -> Point, UVPoint, Distance
iso = IsoCurve(Surface=negative_direction_hypar_3, UVPoint=srf_cp.UVPoint)  # -> UIsocurve, VIsocurve
iso_2 = IsoCurve(Surface=positive_direction_hypar_3, UVPoint=srf_cp_2.UVPoint)  # -> UIsocurve, VIsocurve
iso_3 = IsoCurve(Surface=negative_direction_hypar_4, UVPoint=srf_cp_3.UVPoint)  # -> UIsocurve, VIsocurve
iso_4 = IsoCurve(Surface=positive_direction_hypar_4, UVPoint=srf_cp_4.UVPoint)  # -> UIsocurve, VIsocurve

crv = Curve(iso_2.VIsocurve)
crv_2 = Curve(iso.VIsocurve)

crv_3 = Curve(iso_4.VIsocurve)
crv_4 = Curve(iso_3.VIsocurve)

end = EndPoints(Curve=crv_3)  # -> Start, End
ln = Line(StartPoint=end.Start, EndPoint=end.End)
len = Length(Curve=[crv_3, ln])
panel_2 = Panel(len)
