# Grasshopper definition Nurbs hyperboloid.gh (Grasshopper 1.0.7)
# plug-ins: Bifocals, HFTidyCanvas

panel = Panel("""a = radius 1
b = radius 2
c = asymptote
d = depth
h = height""")

# ---- group: HYPOBOLOID GENERATION
number_slider = Slider(1, range=0..10)
rad = Radians(Degrees=[Slider(50, range=0..90), Slider(30, range=0..90)])
rtrig = RightTrigonometry(Alpha=rad, PLength=number_slider)  # -> Alpha, Beta, PLength, QLength, RLength
number_slider_2 = Slider(3, range=0..30)
python = GhPythonScript(a=number_slider, b=Slider(1.7, range=0..10), c=rtrig.QLength, depth=number_slider_2, h=number_slider_2)  # -> out, hyperboloid, hyperbola
# ---------- python: Python ----------
__author__ = "ashkan"
__version__ = "2021.03.29"

import rhinoscriptsyntax as rs
import scriptcontext
import math

def get_hyperbola(a, c, h) :
    """
    Draws a hyperbola on the XZ plane, centred at 0,0,0.
    """
    
    p0 = [0,0,0]
    p1 = [0,0,0]
    p2 = [0,0,0]
    q = [0,0,0]

    p0[0] = math.sqrt(a**2 * (1 + (h**2 / c**2)))
    p0[2] = h

    p1[0] = (-1 * p0[2]**2 * a**2) / (c**2 * p0[0]) + p0[0]
    p1[2] = 0

    p2[0] = p0[0]
    p2[2] = -h

    q[0] = a
    q[2] = 0

    w1 = (p0[0]-q[0]) / (q[0]-p1[0])

    points = [rs.AddPoint(p0), rs.AddPoint(p1), rs.AddPoint(p2)]
    knots = [0,0,1,1]
    weights = [1,w1,1]
    
    hyperbola = rs.AddNurbsCurve(points,knots,2,weights)
    print(rs.CurveWeights(hyperbola))


    return hyperbola

def get_hyperboloid(a, b, c, depth) :
    hyperbola = get_hyperbola(a, c, depth)   
    axis = rs.AddLine(rs.AddPoint(0,0,0),rs.AddPoint(0,0,1))
    hyperboloid = rs.AddRevSrf(hyperbola,axis)
    
    y_factor = float(b) / float(a)
    hyperboloid = rs.ScaleObject(hyperboloid, rs.AddPoint(0,0,0), [1,y_factor,1])
    return hyperboloid
    
hyperboloid = get_hyperboloid(a, b, c, depth)
hyperbola = get_hyperbola (a,c,h)
# ---------- end python ----------
hyperboloid___brep = DataDescription(python.hyperboloid)

# ----
number_slider_3 = Slider(10, range=0..10)
number_slider_4 = Slider(4.38, range=0..10)
number_slider_5 = Slider(3.3, range=0..10)
rad_2 = Radians(Degrees=Slider(50, range=0..90))
number_slider_6 = Slider(30, range=0..30)
rtrig_2 = RightTrigonometry(Alpha=rad_2, PLength=number_slider_3)  # -> Alpha, Beta, PLength, QLength, RLength
number_slider_7 = Slider(30, range=0..30)
python_2 = GhPythonScript(a=number_slider_5, b=number_slider_5, c=number_slider_4, depth=number_slider_6, h=number_slider_6)  # -> out, hyperboloid, hyperbola; same code as python
python_3 = GhPythonScript(a=number_slider_3, b=Slider(3.8, range=0..10), c=rtrig_2.QLength, depth=number_slider_7, h=number_slider_7)  # -> out, hyperboloid, hyperbola; same code as python
pt = ConstructPoint(XCoordinate=0, YCoordinate=0, ZCoordinate=0)
pt_2 = ConstructPoint(XCoordinate=number_slider_3, YCoordinate=0, ZCoordinate=rtrig_2.QLength)
crv = Curve(python_2.hyperbola)
srf = Surface(python_2.hyperboloid)

# ---- group: HYPOBOLOID GENERATION / Data Description
hyperboloid___brep_2 = Hyperboloid_Srf(hyperboloid___brep)

# ----
vec2pt = Vector2Pt(PointA=pt, PointB=pt_2, Unitize=False)  # -> Vector, Length
crv_2 = Curve(python_3.hyperbola)
srf_2 = Surface(python_3.hyperboloid)
X = UnitX(Factor=1)
rtrig_3 = RightTrigonometry(PLength=number_slider_5, QLength=number_slider_4)  # -> Alpha, Beta, PLength, QLength, RLength
line = LineSDL(Start=pt, Direction=X, Length=1)
line_2 = LineSDL(Start=pt, Direction=vec2pt.Vector, Length=Slider(100, range=0..100))
pt_3 = ConstructPoint(XCoordinate=0, YCoordinate=0, ZCoordinate=0)
pt_4 = ConstructPoint(XCoordinate=number_slider_5, YCoordinate=0, ZCoordinate=number_slider_4)
pt_5 = ConstructPoint(XCoordinate=0, YCoordinate=0, ZCoordinate=0)
end = EndPoints(Curve=crv)  # -> Start, End
angle = Angle(VectorA=line, VectorB=line_2)  # -> Angle, Reflex
pt_6 = ConstructPoint(XCoordinate=0, YCoordinate=0, ZCoordinate=0)
end_2 = EndPoints(Curve=crv_2)  # -> Start, End
vec2pt_2 = Vector2Pt(PointA=pt_3, PointB=pt_4, Unitize=False)  # -> Vector, Length
X_2 = UnitX(Factor=1)
deg = Degrees(Radians=angle.Angle)
angledim = AngularDimension(Center=pt_5, PointA=end.Start, PointB=end.End, Reflex=False, Text="{0:0.0}°", Size=Slider(0.5, range=0..1))
number_slider_8 = Slider(0.5, range=0..1)
hyperboloid___brep_3 = Hyperboloid_Srf(hyperboloid___brep)
angledim_2 = AngularDimension(Center=pt_6, PointA=end_2.Start, PointB=end_2.End, Reflex=False, Text="{0:0.0}°", Size=Slider(0.5, range=0..1))
line_3 = LineSDL(Start=pt_3, Direction=X_2, Length=1)
line_4 = LineSDL(Start=pt_3, Direction=vec2pt_2.Vector, Length=Slider(100, range=0..100))
panel_2 = Panel(deg)
angle_2 = Angle(VectorA=line_3, VectorB=line_4)  # -> Angle, Reflex
item = ListItem(List=hyperboloid___brep_3, Index=0, Wrap=True)  # -> Item, Item1
dom²num = ConstructDomain²(UMin=0, UMax=1, VMin=0, VMax=number_slider_8)
dom²num_2 = ConstructDomain²(UMin=0, UMax=1, VMin=number_slider_8, VMax=1)
deg_2 = Degrees(Radians=rtrig_3.Alpha)
deg_3 = Degrees(Radians=angle_2.Angle)
panel_3 = Panel(deg_3)
panel_4 = Panel(deg_2)
subsrf = Isotrim(Surface=reparameterize(item.Item), Domain=dom²num)
subsrf_2 = Isotrim(Surface=reparameterize(item.Item1), Domain=dom²num_2)
join = BrepJoin(Breps=[subsrf, subsrf_2])  # -> Breps, Closed
