# Grasshopper definition Nurbs hyperboloid_v1.gh (Grasshopper 1.0.7)
# plug-ins: HFTidyCanvas, Pufferfish, Human, Heteroptera

panel = Panel("""a = radius 1
b = radius 2
c = asymptote
d = depth
h = height""")
number_slider = Slider(30, range=0..90)  # disabled

# ---- group: HYPOBOLOID GENERATION
number_slider_2 = Slider(30, range=0..90)  # disabled
number_slider_3 = Slider(1, range=0..10)  # disabled
number_slider_4 = Slider(1.8, range=0..10)  # disabled
rad = Radians(Degrees=[number_slider_2, number_slider])  # disabled
rtrig = RightTrigonometry(Alpha=rad, PLength=number_slider_3)  # -> Alpha, Beta, PLength, QLength, RLength; disabled
number_slider_5 = Slider(3, range=0..30)  # disabled
python = GhPythonScript(a=number_slider_3, b=number_slider_4, c=rtrig.QLength, depth=number_slider_5, h=number_slider_5)  # -> out, hyperboloid, hyperbola; disabled
# ---------- python: Python ----------
__author__ = "ashkan"
__version__ = "2021.03.29"

import rhinoscriptsyntax as rs
import scriptcontext
import math

def get_hyperbola(a, c, h) :
    """
    Draws a hyperbola on the XZ plane, centred at 0,0,0.
    """
    
    p0 = [0,0,0]
    p1 = [0,0,0]
    p2 = [0,0,0]
    q = [0,0,0]

    p0[0] = math.sqrt(a**2 * (1 + (h**2 / c**2)))
    p0[2] = h

    p1[0] = (-1 * p0[2]**2 * a**2) / (c**2 * p0[0]) + p0[0]
    p1[2] = 0

    p2[0] = p0[0]
    p2[2] = -h

    q[0] = a
    q[2] = 0

    w1 = (p0[0]-q[0]) / (q[0]-p1[0])

    points = [rs.AddPoint(p0), rs.AddPoint(p1), rs.AddPoint(p2)]
    knots = [0,0,1,1]
    weights = [1,w1,1]
    
    hyperbola = rs.AddNurbsCurve(points,knots,2,weights)
    print(rs.CurveWeights(hyperbola))


    return hyperbola

def get_hyperboloid(a, b, c, depth) :
    hyperbola = get_hyperbola(a, c, depth)   
    axis = rs.AddLine(rs.AddPoint(0,0,0),rs.AddPoint(0,0,1))
    hyperboloid = rs.AddRevSrf(hyperbola,axis)
    
    y_factor = float(b) / float(a)
    hyperboloid = rs.ScaleObject(hyperboloid, rs.AddPoint(0,0,0), [1,y_factor,1])
    return hyperboloid
    
hyperboloid = get_hyperboloid(a, b, c, depth)
hyperbola = get_hyperbola (a,c,h)
# ---------- end python ----------
hyperboloid___brep = DataDescription(python.hyperboloid)  # disabled

# ----
number_slider_6 = Slider(60, range=0..90)  # disabled
number_slider_7 = Slider(7.2, range=0..10)  # disabled
number_slider_8 = Slider(6.4, range=0..10)  # disabled
number_slider_9 = Slider(4.65, range=0..10)  # disabled
number_slider_10 = Slider(4.2, range=0..10)  # disabled
number_slider_11 = Slider(3.5, range=0..10)  # disabled
rad_2 = Radians(Degrees=number_slider_6)  # disabled
number_slider_12 = Slider(30, range=0..30)  # disabled
rtrig_2 = RightTrigonometry(Alpha=rad_2, PLength=number_slider_7)  # -> Alpha, Beta, PLength, QLength, RLength; disabled
number_slider_13 = Slider(100, range=0..100)  # disabled
python_2 = GhPythonScript(a=number_slider_10, b=number_slider_11, c=number_slider_9, depth=number_slider_12, h=number_slider_12)  # -> out, hyperboloid, hyperbola; disabled; same code as python
python_3 = GhPythonScript(a=number_slider_7, b=number_slider_8, c=rtrig_2.QLength, depth=number_slider_13, h=number_slider_13)  # -> out, hyperboloid, hyperbola; disabled; same code as python
pt = ConstructPoint(XCoordinate=0, YCoordinate=0, ZCoordinate=0)  # disabled
pt_2 = ConstructPoint(XCoordinate=number_slider_7, YCoordinate=0, ZCoordinate=rtrig_2.QLength)  # disabled
number_slider_14 = Slider(45.6, range=0..100)  # disabled
srf = Surface(python_2.hyperboloid)  # disabled
crv = Curve(python_2.hyperbola)  # disabled

# ---- group: HYPOBOLOID GENERATION / Data Description
hyperboloid___brep_2 = Hyperboloid_Srf(hyperboloid___brep)  # disabled

# ----
vec2pt = Vector2Pt(PointA=pt, PointB=pt_2, Unitize=False)  # -> Vector, Length; disabled
crv_2 = Curve(python_3.hyperbola)  # disabled
srf_2 = Surface(python_3.hyperboloid)  # disabled
X = UnitX(Factor=1)  # disabled
number_slider_15 = Slider(0.5, range=0..1)  # disabled
line = LineSDL(Start=pt, Direction=X, Length=1)  # disabled
line_2 = LineSDL(Start=pt, Direction=vec2pt.Vector, Length=number_slider_14)  # disabled
pt_3 = ConstructPoint(XCoordinate=number_slider_10, YCoordinate=0, ZCoordinate=number_slider_9)  # disabled
pt_4 = ConstructPoint(XCoordinate=0, YCoordinate=0, ZCoordinate=0)  # disabled
rtrig_3 = RightTrigonometry(PLength=number_slider_10, QLength=number_slider_9)  # -> Alpha, Beta, PLength, QLength, RLength; disabled
number_slider_16 = Slider(1, range=0..1)  # disabled
number_slider_17 = Slider(100, range=0..100)  # disabled
pt_5 = ConstructPoint(XCoordinate=0, YCoordinate=0, ZCoordinate=0)  # disabled
end = EndPoints(Curve=crv)  # -> Start, End; disabled
angle = Angle(VectorA=line, VectorB=line_2)  # -> Angle, Reflex; disabled
pt_6 = ConstructPoint(XCoordinate=0, YCoordinate=0, ZCoordinate=0)  # disabled
end_2 = EndPoints(Curve=crv_2)  # -> Start, End; disabled
vec2pt_2 = Vector2Pt(PointA=pt_4, PointB=pt_3, Unitize=False)  # -> Vector, Length; disabled
X_2 = UnitX(Factor=1)  # disabled
deg = Degrees(Radians=angle.Angle)  # disabled
angledim = AngularDimension(Center=pt_5, PointA=end.Start, PointB=end.End, Reflex=False, Text="{0:0.0}°", Size=number_slider_15)  # disabled
number_slider_18 = Slider(0.5, range=0..1)  # disabled
hyperboloid___brep_3 = Hyperboloid_Srf(hyperboloid___brep)  # disabled
angledim_2 = AngularDimension(Center=pt_6, PointA=end_2.Start, PointB=end_2.End, Reflex=False, Text="{0:0.0}°", Size=number_slider_16)  # disabled
line_3 = LineSDL(Start=pt_4, Direction=X_2, Length=1)  # disabled
line_4 = LineSDL(Start=pt_4, Direction=vec2pt_2.Vector, Length=number_slider_17)  # disabled
panel_2 = Panel(deg)  # disabled
angle_2 = Angle(VectorA=line_3, VectorB=line_4)  # -> Angle, Reflex; disabled
deg_2 = Degrees(Radians=rtrig_3.Alpha)  # disabled
item = ListItem(List=hyperboloid___brep_3, Index=0, Wrap=True)  # -> Item, Item1; disabled
dom²num = ConstructDomain²(UMin=0, UMax=1, VMin=0, VMax=number_slider_18)  # disabled
dom²num_2 = ConstructDomain²(UMin=0, UMax=1, VMin=number_slider_18, VMax=1)  # disabled
deg_3 = Degrees(Radians=angle_2.Angle)  # disabled
multiplication = Multiplication(A=deg_2, B=2)  # disabled
panel_3 = Panel(deg_3)  # disabled
panel_4 = Panel(multiplication)  # disabled
subsrf = Isotrim(Surface=reparameterize(item.Item), Domain=dom²num)  # disabled
subsrf_2 = Isotrim(Surface=reparameterize(item.Item1), Domain=dom²num_2)  # disabled
join = BrepJoin(Breps=[subsrf, subsrf_2])  # -> Breps, Closed; disabled

# ---- group: HYPOBOLOID GENERATION
number_slider_19 = Slider(0.2, range=0..10)
rad_3 = Radians(Degrees=Slider(20, range=0..90))
rtrig_4 = RightTrigonometry(Alpha=rad_3, PLength=number_slider_19)  # -> Alpha, Beta, PLength, QLength, RLength
number_slider_20 = Slider(1, range=0..30)
python_4 = GhPythonScript(a=number_slider_19, b=number_slider_19, c=rtrig_4.QLength, depth=number_slider_20, h=number_slider_20)  # -> out, hyperboloid, hyperbola; same code as python

# ----
cap = CapHoles(Brep=python_4.hyperboloid)

# ---- group: HYPOBOLOID GENERATION (continued)
hyperboloid___brep_4 = DataDescription(cap)

# ---- group: HYPOBOLOID GENERATION / Data Description
hyperboloid___brep_5 = Hyperboloid_Srf(hyperboloid___brep_4)

# ---- group: HYPOBOLOID GENERATION
number_slider_21 = Slider(0.15, range=0..10)
rad_4 = Radians(Degrees=Slider(30, range=0..90))
rtrig_5 = RightTrigonometry(Alpha=rad_4, PLength=number_slider_21)  # -> Alpha, Beta, PLength, QLength, RLength
number_slider_22 = Slider(1, range=0..30)
python_5 = GhPythonScript(a=number_slider_21, b=number_slider_21, c=rtrig_5.QLength, depth=number_slider_22, h=number_slider_22)  # -> out, hyperboloid, hyperbola; same code as python

# ----
cap_2 = CapHoles(Brep=python_5.hyperboloid)

# ---- group: HYPOBOLOID GENERATION (continued)
hyperboloid___brep_6 = DataDescription(cap_2)

# ---- group: HYPOBOLOID GENERATION / Data Description
hyperboloid___brep_7 = Hyperboloid_Srf(hyperboloid___brep_6)

# ----
number_slider_23 = Slider(0.54, range=0..1)  # disabled
number_slider_24 = Slider(4, range=0..10)  # disabled
crv_3 = Curve(<curve referenced from the Rhino model>)  # disabled
number_slider_25 = Slider(-0.006, range=-0.25..0.25)  # disabled
center = Center(Geometrical=crv_3)  # -> Center, Dimension; disabled
number_slider_26 = Slider(-0.093, range=-0.25..0.25)  # disabled
number_slider_27 = Slider(0.041, range=-0.25..0.25)  # disabled
cir = Circle(Plane=center.Center, Radius=number_slider_23)  # disabled
pi = Pi(Factor=number_slider_25)  # disabled
hframes = HorizontalFrames(Curve=cir, Count=number_slider_24)  # -> Frames, Parameters; disabled
dom = ConstructDomain(DomainStart=number_slider_26, DomainEnd=number_slider_27)  # disabled
neg = Negative(Value=pi)  # disabled
range = Range(Domain=dom, Steps=expr("x-1", number_slider_24))  # disabled
deplane = DeconstructPlane(Plane=hframes.Frames)  # -> Origin, XAxis, YAxis, ZAxis; disabled
merge = Merge(Data1=pi, Data2=neg)  # disabled
number_slider_28 = Slider(0.75, range=0..1)  # disabled
pi_2 = Pi(Factor=range)  # disabled
long = LongestList(ListA=deplane.ZAxis, ListB=merge, PaddingMode=4)  # -> ListA, ListB; disabled
hyperboloid___brep_8 = Hyperboloid_Srf(hyperboloid___brep_6)  # disabled
line_5 = LineSDL(Start=deplane.Origin, Direction=deplane.YAxis, Length=1)  # disabled
boundary = BoundarySurfaces(Edges=crv_3)  # disabled
neg_2 = Negative(Value=number_slider_28)  # disabled
rotax = RotateAxis(Geometry=hframes.Frames, Angle=pi_2, Axis=line_5)  # -> Geometry, Transform; disabled
offsrf = OffsetSurface(Surface=boundary, Distance=number_slider_28, BothSides=neg_2, CreateSolid=True)  # disabled
orient = Orient(Geometry=hyperboloid___brep_8, Source=PlaneXY(0, 0, 0), Target=rotax.Geometry)  # -> Geometry, Transform; disabled
sdiff = SolidDifference(BrepsA=offsrf, BrepsB=orient.Geometry)  # disabled
debrep = DeconstructBrep(Brep=sdiff)  # -> Faces, Edges, Vertices; disabled
planar = IsPlanar(Surface=debrep.Faces, Interior=True)  # -> Planar, Plane; disabled
cull = CullPattern(List=debrep.Faces, CullPattern=invert(planar.Planar))  # disabled
edges = BrepEdges(Brep=cull)  # -> Naked, Interior, NonManifold; disabled
midpt = CurveMiddle(Curve=edges.Naked)  # disabled
brep_cp = BrepClosestPoint(Point=midpt, Brep=offsrf)  # -> Point, Normal, Distance; disabled
panel_5 = Panel("0.01")  # disabled
number_slider_29 = Slider(0.02, range=0..1)  # disabled
larger = LargerThan(FirstNumber=brep_cp.Distance, SecondNumber=panel_5)  # -> LargerThan, OrEqualTo; disabled
swatch = ColourSwatch(SwatchColor=RGB(0, 0, 0))  # disabled
cull_2 = CullPattern(List=edges.Naked, CullPattern=larger.LargerThan)  # disabled
previewlw = CustomPreviewLineweights(Geometry=cull_2, Shader=swatch, Thickness=number_slider_29, Absolute=invert(False))  # disabled

crv_4 = Curve(<curve referenced from the Rhino model>)
center_2 = Center(Geometrical=crv_4)  # -> Center, Dimension
cir_2 = Circle(Plane=center_2.Center, Radius=Slider(0.54, range=0..1))
center_3 = Center(Geometrical=crv_4)  # -> Center, Dimension
hframes_2 = HorizontalFrames(Curve=cir_2, Count=Slider(4, range=0..10))  # -> Frames, Parameters
deplane_2 = DeconstructPlane(Plane=hframes_2.Frames)  # -> Origin, XAxis, YAxis, ZAxis
hyperboloid___brep_9 = Hyperboloid_Srf(hyperboloid___brep_4)
number_slider_30 = Slider(0.75, range=0..1)
hyperboloid___brep_10 = Hyperboloid_Srf(hyperboloid___brep_6)
pi_3 = Pi(Factor=Slider(0.085, range=-0.25..0.25))
line_6 = LineSDL(Start=deplane_2.Origin, Direction=deplane_2.YAxis, Length=1)
boundary_2 = BoundarySurfaces(Edges=crv_4)
neg_3 = Negative(Value=number_slider_30)
rotax_2 = RotateAxis(Geometry=hframes_2.Frames, Angle=pi_3, Axis=line_6)  # -> Geometry, Transform
offsrf_2 = OffsetSurface(Surface=boundary_2, Distance=number_slider_30, BothSides=neg_3, CreateSolid=True)
orient_2 = Orient(Geometry=hyperboloid___brep_10, Source=PlaneXY(0, 0, 0), Target=rotax_2.Geometry)  # -> Geometry, Transform
orient_3 = Orient(Geometry=hyperboloid___brep_9, Source=PlaneXY(0, 0, 0), Target=center_3.Center)  # -> Geometry, Transform
merge_2 = Merge(Data1=orient_2.Geometry, Data2=orient_3.Geometry)  # -> flatten(Result)
sdiff_2 = SolidDifference(BrepsA=offsrf_2, BrepsB=merge_2)
debrep_2 = DeconstructBrep(Brep=sdiff_2)  # -> Faces, Edges, Vertices
planar_2 = IsPlanar(Surface=debrep_2.Faces, Interior=True)  # -> Planar, Plane
cull_3 = CullPattern(List=debrep_2.Faces, CullPattern=invert(planar_2.Planar))
edges_2 = BrepEdges(Brep=cull_3)  # -> Naked, Interior, NonManifold
midpt_2 = CurveMiddle(Curve=edges_2.Naked)
brep_cp_2 = BrepClosestPoint(Point=midpt_2, Brep=offsrf_2)  # -> Point, Normal, Distance
larger_2 = LargerThan(FirstNumber=brep_cp_2.Distance, SecondNumber="0.01")  # -> LargerThan, OrEqualTo
cull_4 = CullPattern(List=edges_2.Naked, CullPattern=larger_2.LargerThan)
previewlw_2 = CustomPreviewLineweights(
    Geometry=cull_4,
    Shader=ColourSwatch(SwatchColor=RGB(0, 0, 0)),
    Thickness=Slider(0.02, range=0..1),
    Absolute=invert(False))

pipeline = GeometryPipeline(
    GroupByLayer=False,
    GroupByType=False,
    IncludeHidden=True,
    IncludeLocked=True,
    LayerFilter="planes",
    NameFilter="*",
    SublayerFiltering=True,
    TypeFilter=1073741848)  # disabled
hyperboloid___brep_11 = Hyperboloid_Srf(hyperboloid___brep_6)  # disabled
panel_6 = Panel("{0.5,0.5,0}")  # disabled
evalsrf = EvaluateSurface(Surface=reparameterize(pipeline), Point=panel_6)  # -> Point, Normal, UDirection, VDirection, Frame; disabled
number_slider_31 = Slider(0.59, range=0..1)  # disabled
crv_5 = Curve(<curve referenced from the Rhino model>)  # disabled
geometry_pipeline = Pipeline(evalsrf.Frame)  # disabled
boundary_3 = BoundarySurfaces(Edges=crv_5)  # disabled
neg_4 = Negative(Value=number_slider_31)  # disabled
offsrf_3 = OffsetSurface(Surface=boundary_3, Distance=number_slider_31, BothSides=neg_4, CreateSolid=True)  # disabled
orient_4 = Orient(Geometry=hyperboloid___brep_11, Source=PlaneXY(0, 0, 0), Target=geometry_pipeline)  # -> Geometry, Transform; disabled
sdiff_3 = SolidDifference(BrepsA=offsrf_3, BrepsB=orient_4.Geometry)  # disabled
debrep_3 = DeconstructBrep(Brep=sdiff_3)  # -> Faces, Edges, Vertices; disabled
planar_3 = IsPlanar(Surface=debrep_3.Faces, Interior=True)  # -> Planar, Plane; disabled
cull_5 = CullPattern(List=debrep_3.Faces, CullPattern=invert(planar_3.Planar))  # disabled
edges_3 = BrepEdges(Brep=cull_5)  # -> Naked, Interior, NonManifold; disabled
midpt_3 = CurveMiddle(Curve=edges_3.Naked)  # disabled
brep_cp_3 = BrepClosestPoint(Point=midpt_3, Brep=offsrf_3)  # -> Point, Normal, Distance; disabled
panel_7 = Panel("0.01")  # disabled
number_slider_32 = Slider(0.02, range=0..1)  # disabled
larger_3 = LargerThan(FirstNumber=brep_cp_3.Distance, SecondNumber=panel_7)  # -> LargerThan, OrEqualTo; disabled
swatch_2 = ColourSwatch(SwatchColor=RGB(0, 0, 0))  # disabled
cull_6 = CullPattern(List=edges_3.Naked, CullPattern=larger_3.LargerThan)  # disabled
previewlw_3 = CustomPreviewLineweights(Geometry=cull_6, Shader=swatch_2, Thickness=number_slider_32, Absolute=invert(False))  # disabled
