# Grasshopper definition Point Attractor_c#.gh (Grasshopper 1.0.8)

pt = Point(Point(171.6730252, 97.57837507, 0))
c_script = CSharpScript(x=Slider(60, range=0..1000), y=Slider(40, range=0..1000), z=pt)  # -> out, a, b; inputs x: Double, y: Double, z: Point3d
# ---------- c_script: C# ----------
// Grasshopper Script Instance
#region Usings
using System;
using System.Linq;
using System.Collections;
using System.Collections.Generic;
using System.Drawing;

using Rhino;
using rg = Rhino.Geometry;

using Grasshopper;
using Grasshopper.Kernel;
using Grasshopper.Kernel.Data;
using Grasshopper.Kernel.Types;
#endregion

public class Script_Instance : GH_ScriptInstance
{
    #region Notes
    /* 
      Members:
        RhinoDoc RhinoDocument
        GH_Document GrasshopperDocument
        IGH_Component Component
        int Iteration

      Methods (Virtual & overridable):
        Print(string text)
        Print(string format, params object[] args)
        Reflect(object obj)
        Reflect(object obj, string method_name)
    */
    #endregion

    private void RunScript(
		double x,
		double y,
		Rhino.Geometry.Point3d z,
		ref object a,
		ref object b)
    {
        // List<rg.Point3d> centers = new List<rg.Point3d>();
        List<rg.Sphere> spheres = new List<rg.Sphere>();

        for (int i = 0; i < x; i+=5) {
            for (int j = 0; j < y; j+=5) {
                rg.Point3d curPoint = new rg.Point3d(5*i, 5*j, 0);
                double curRad = (curPoint.DistanceTo(z))/20;
                rg.Sphere curSphere = new rg.Sphere(curPoint, curRad);
                spheres.Add(curSphere);
            }
        } 



        a = spheres;
    }
}
# ---------- end c_script ----------
panel = Panel(c_script.out)
panel_2 = Panel(c_script.a)
