# Grasshopper definition Sorting curve Segments accoding to z values and placing them in branches.gh (Grasshopper 1.0.8)
# plug-ins: Parakeet

# ----
# Points as Input
pt = Point()
pt_2 = Point()

# ----
# Sample File for Sorting random curves rowWise
merge = Merge(Data1=pt, Data2=pt_2)  # -> flatten(Result)
pdecon = Deconstruct(Point=merge)  # -> XComponent, YComponent, ZComponent
custom_round = CustomRound(Numbers=pdecon.ZComponent, Scope=Slider(50, range=0..100))
cset = CreateSet(List=custom_round)  # -> Set, Map
cset_2 = CreateSet(List=cset.Map)  # -> Set, Map
mindex = MemberIndex(Set=cset.Map, Member=cset_2.Set)  # -> Index, Count
item = ListItem(List=merge, Index=mindex.Index, Wrap=True)
