# Grasshopper definition Sunpath.gh (Grasshopper 1.0.7)
# plug-ins: Human

rhino_project_units = ValueList({"Millimeters", "Centimeters", "Meters", "Inches", "Feet"}, selected="Millimeters")
# LB_CapeTown
# AG_2023.02.05
panel = Panel("https://energyplus-weather.s3.amazonaws.com/africa_wmo_region_1/ZAF/ZAF_Cape.Town.688160_IWEC/ZAF_Cape.Town.688160_IWEC.zip")
data_dam = DataDam(DataDataA=panel, BufferDelay=10000000, BufferMode=0)

# ---- group: Winter
analysisperiod = LBAnalysisPeriod(
    start_month=Slider(9, range=1..12),
    start_day=Slider(1, range=1..28),
    start_hour=Slider(1, range=1..24),
    end_month=Slider(3, range=1..12),
    end_day=Slider(1, range=1..28),
    end_hour=Slider(23, range=0..100),
    timestep=Slider(1, range=1..24))  # -> period, hoys, dates; plug-in component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

# ---- group: Summer
analysisperiod_2 = LBAnalysisPeriod(
    start_month=Slider(6, range=1..12),
    start_day=Slider(1, range=1..28),
    start_hour=Slider(1, range=1..24),
    end_month=Slider(9, range=1..12),
    end_day=Slider(1, range=1..28),
    end_hour=Slider(23, range=0..100),
    timestep=Slider(1, range=1..24))  # -> period, hoys, dates; plug-in component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

# ----
downloadepw = LBDownloadWeather(weather_URL=data_dam)  # -> epw_file, stat_file, ddy_file; plug-in component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
importepw = LBImportEPW(epw_file=downloadepw.epw_file)  # -> location, dry_bulb_temperature, dew_point_temperature, relative_humidity, wind_speed, wind_direction, direct_normal_rad, diffuse_horizontal_rad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; plug-in component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

# ----
# Winter-False
# Summer-True
boolean_toggle = BooleanToggle(True)

stream_filter = StreamFilter(Gate=boolean_toggle, Stream0=analysisperiod.hoys, Stream1=analysisperiod_2.hoys)
size_of_the_graphics = Slider(1.5, range=0..2)

# ---- group: North
vector = Vector(Vector(-218.7702788, -2.259258145, 0))

# ----
sunpath = LBSunPath(north=vector, location=importepw.location, hoys=stream_filter, scale=size_of_the_graphics)  # -> out, vectors, altitudes, azimuths, hoys, sun_pts, analemma, daily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; plug-in component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

# ---- group: Sun Path Line Colour
data = Data(sunpath.analemma)
custom_preview_lineweights = CustomPreviewLineweights(
    Geometry=data,
    Shader={diffuse=RGB(255, 105, 180), emission=RGB(76, 32, 54), shine=0.5, specular=RGB(255, 255, 255), transparency=0},
    Absolute=False)

# ---- group: Sun Angle Colour
data_2 = Data(sunpath.daily)
custom_preview_lineweights_2 = CustomPreviewLineweights(
    Geometry=data_2,
    Shader={diffuse=RGB(255, 105, 180), emission=RGB(76, 32, 54), shine=0.5, specular=RGB(255, 255, 255), transparency=0},
    Absolute=False)

# ---- group: Compass Colour
data_3 = Data(sunpath.compass)
custom_preview_lineweights_3 = CustomPreviewLineweights(
    Geometry=data_3,
    Shader={diffuse=RGB(255, 105, 180), emission=RGB(76, 32, 54), shine=0.5, specular=RGB(255, 255, 255), transparency=0},
    Absolute=False)

# ---- group: Sun Colour
sphere = Sphere(Base=sunpath.sun_pts, Radius=1)
custom_preview = CustomPreview(Geometry=sphere, Material=ColourSwatch(SwatchColor=RGB(85, 255, 0)))
