# Grasshopper definition TableF+P.gh (Grasshopper 1.0.8)
# plug-ins: LunchBox, LadybugGrasshopper, Kangaroo2 Components

merge = Merge(Data1=Slider(240, range=0..500), Data2="0")
xy = XYPlane(Origin=Point(0, 0, 0))
pl_offset = PlaneOffset(BasePlane=xy, Offset=merge)
merge_2 = Merge(Data1=Slider(129, range=0..200), Data2=Slider(172, range=0..1000))
cir = Circle(Plane=pl_offset, Radius=merge_2)
item = ListItem(List=cir, Index=0, Wrap=True)  # -> Item, Item1
divide = DivideCurve(Curve=item.Item1, Count=Slider(6, range=6..12), Kinks=False)  # -> Points, Tangents, Parameters
scale = Scale(Geometry=item.Item, Center=item.Item, Factor=Slider(1.41, range=0..2))  # -> Geometry, Transform
pline = PolyLine(Vertices=divide.Points, Closed=invert(False))
boundary = BoundarySurfaces(Edges=scale.Geometry)
Z = UnitZ(Factor=Slider(5, range=0..10))
extr = ExtrudePoint(Base=pline, Point=xy)
extr_2 = Extrude(Base=boundary, Direction=Z)
smesh = SimpleMesh(Brep=extr)
refine = Refine(Mesh=smesh, Level=Slider(4, range=1..6))
preview = CustomPreview(Geometry=extr_2, Material=ColourSwatch(SwatchColor=RGBA(227, 255, 244, 140)))
nv = NakedVertices(Mesh=refine)  # -> ClothedIndex, NakedIndex, ClothedPts, NakedPts
cps = ClosestPoints(Point=divide.Tangents, Cloud=nv.NakedPts, Count="3")  # -> ClosestPoint, CPIndex, Distance
cull_i = CullIndex(List=cps.ClosestPoint, Indices="0", Wrap=True)
pline_2 = PolyLine(Vertices=cull_i, Closed=False)  # -> flatten(Polyline)
alongcrv = SortAlongCurve(Points=cps.ClosestPoint, Curve=graft(pline_2))  # -> Points, Indices
midpt = CurveMiddle(Curve=pline_2)
lng = ListLength(List=pline_2)
crv_cp = CurveClosestPoint(Point=midpt, Curve=item.Item)  # -> Point, Parameter, Distance
panel = Panel("""0
1""")
repeat = RepeatData(Data=panel, Length=lng)
vec2pt = Vector2Pt(PointA=midpt, PointB=crv_cp.Point, Unitize=False)  # -> Vector, Length
multiplication = Multiplication(A=vec2pt.Vector, B=repeat)
move = Move(Geometry=pline_2, Motion=multiplication)  # -> Geometry, Transform
divide_2 = DivideCurve(Curve=move.Geometry, Count=expr("x-1", "3"), Kinks=False)  # -> Points, Tangents, Parameters
edgelengths = EdgeLengths(Mesh=refine, LengthFactor=Slider(0.1, range=0..1), Strength=1)
anchor = Anchor(Point=alongcrv.Points, Target=divide_2.Points, Strength=10000)
show = Show(G=refine)
entwine = Entwine(Branch00=show, Branch01=[edgelengths, anchor], FlattenInputs=True)
falsestart = LBFalseStartToggle(True)
solver = Solver(GoalObjects=entwine, Reset=Button(), Threshold=1e-15, Tolerance=0.0001, On=falsestart)  # -> I, V, simplify(O)
bang = ExplodeTree(Data=solver.O)  # -> Branch0, Branch1
mesh = Mesh(bang.Branch0)
toggle = BooleanToggle(True)
dam = DataDam(DataA=mesh, BufferDelay=10000000, BufferMode=0)
mshoffset = MeshOffset(Mesh=dam, OffsetDistance=Slider(3, range=0..10), SolidToggle=toggle, OffsetBothSidesToggle=toggle)
preview_2 = CustomPreview(Geometry=mshoffset, Material=ColourSwatch(SwatchColor=RGB(255, 255, 255)))
