# Grasshopper definition WavyPattern.gh (Grasshopper 1.0.8)
# plug-ins: ShapeDiverForGrasshopper

sddp = ShapeDiverDocumentPayload({AbsoluteTolerance=0, AngleTolerance=0, DistanceDisplayPrecision=0, GltfVersion="Gltf2", GrasshopperVersion="1.0.0008", InputGroups="{}", OutputGroups="{}", RelativeTolerance=0, RhinoVersion="8.19.25132.1001", UnitSystem=0, VersionCreated="1.26.0.0", VersionSaved="1.26.0.0"})
recgrid = Rectangular(
    Plane=PlaneXY(0, 0, 0),
    SizeX=Slider(2, range=0..10),
    SizeY=Slider(6, range=0..10),
    ExtentX=Slider(1, range=0..100),
    ExtentY=Slider(22, range=0..100))  # -> Cells, Points
tstat = TreeStatistics(Tree=recgrid.Cells)  # -> Paths, Length, Count
item = ListItem(List=tstat.Paths, Index=0, Wrap=True)
branch = TreeBranch(Tree=recgrid.Cells, Path=item, MaintainPaths=True)
cp = ControlPoints(Curve=branch)  # -> Points, Weights, Knots
cull_i = CullIndex(List=cp.Points, Indices=0, Wrap=True)
dispatch = Dispatch(List=cull_i, DispatchPattern=[True, False])  # -> ListA, ListB
pline = PolyLine(Vertices=dispatch.ListB, Closed=False)
pline_2 = PolyLine(Vertices=dispatch.ListA, Closed=False)
merge = Merge(Data1=pline_2, Data2=pline)  # -> simplify(Result)
group = Group(Geometry=merge)  # -> flatten(Group)
dispatch_2 = Dispatch(List=group, DispatchPattern=[True, False])  # -> ListA, ListB
ungroup = Ungroup(Group=dispatch_2.ListA)
ungroup_2 = Ungroup(Group=dispatch_2.ListB)
item_2 = ListItem(List=ungroup, Index=0, Wrap=True)
item_3 = ListItem(List=ungroup_2, Index="1", Wrap=True)
merge_2 = Merge(Data1=item_2, Data2=item_3)  # -> flatten(Result)
join = JoinCurves(Curves=merge_2, Preserve=False)
redpline = Reduce(Polyline=join, Tolerance=1)  # -> Polyline, Reduction
cp_2 = ControlPoints(Curve=redpline.Polyline)  # -> Points, Weights, Knots
intcrv = Interpolate(Vertices=cp_2.Points, Degree=3, Periodic=False, KnotStyle=1)  # -> Curve, Length, Domain
mirror = Mirror(Geometry=intcrv.Curve, Plane=PlaneYZ(0, 0, 0))  # -> Geometry, Transform
merge_3 = Merge(Data1=intcrv.Curve, Data2=mirror.Geometry)
group_2 = Group(Geometry=merge_3)
bbox = BoundingBox(Content=group_2, Plane=PlaneXY(0, 0, 0))  # -> Box, Box_2
series = Series(Start=0, Step=Slider(15, range=0..100), Count=Slider(50, range=0..100))
series_2 = Series(Start=0, Step=Slider(15, range=0..100), Count=Slider(50, range=0..100))
rad = Radians(Degrees=series)
rad_2 = Radians(Degrees=series_2)
area = Area(Geometry=bbox.Box)  # -> Area, Centroid
sin = Sine(Value=rad)
cos = Cosine(Value=rad_2)
bnd = Bounds(Numbers=sin)
dom = ConstructDomain(DomainStart=Slider(0.5, range=0..1), DomainEnd=Slider(1.5, range=0..2))
bnd_2 = Bounds(Numbers=cos)
dom_2 = ConstructDomain(DomainStart=Slider(3.5, range=0..10), DomainEnd=Slider(30, range=0..30))
remap = RemapNumbers(Value=sin, Source=bnd, Target=dom)  # -> Mapped, Clipped
remap_2 = RemapNumbers(Value=cos, Source=bnd_2, Target=dom_2)  # -> Mapped, Clipped
scale_nu = ScaleNU(Geometry=group_2, Plane=area.Centroid, ScaleX=remap.Mapped, ScaleY=1, ScaleZ=1)  # -> Geometry, Transform

bbox_2 = BoundingBox(Content=scale_nu.Geometry, Plane=PlaneXY(0, 0, 0))  # -> Box, Box_2
debox = DeconstructBox(Box=bbox_2.Box)  # -> Plane, X, Y, Z
dedomain = DeconstructDomain(Domain=debox.X)  # -> Start, End
subtraction = Subtraction(A=dedomain.End, B=dedomain.Start)
consec = ConsecutiveDomains(Numbers=subtraction, Additive=True)
dedomain_2 = DeconstructDomain(Domain=consec)  # -> Start, End
merge_4 = Merge(Data1=0, Data2=flatten(dedomain_2.Start))

X = UnitX(Factor=merge_4)
move = Move(Geometry=scale_nu.Geometry, Motion=X)  # -> Geometry, Transform
ungroup_3 = Ungroup(Group=move.Geometry)  # -> simplify(Geometry)
Z = UnitZ(Factor=remap_2.Mapped)  # -> simplify(graft(UnitVector))
extr = Extrude(Base=ungroup_3, Direction=Z)
flatten = FlattenTree(Tree=extr, Path="{0}")
lng = ListLength(List=flatten)  # -> expr("x-1", Length)
range = Range(Domain=Domain(0, 1), Steps=lng)
frgb = ColourRGBF(Alpha=1, Red=range, Green=range, Blue=0)  # -> graft(Colour)
preview = CustomPreview(Geometry=extr, Material=frgb)
