# Grasshopper definition dronePort.gh (Grasshopper 1.0.8)
# plug-ins: LadybugGrasshopper, Weaverbird

anchor = Point([<point referenced from the Rhino model> x15])
pull = Point([<point referenced from the Rhino model> x24])
crv = Curve([<curve referenced from the Rhino model> x8])
edge_points = Point([<point referenced from the Rhino model> x72])
# Drone Port - F+ P
mesh = Mesh([<mesh referenced from the Rhino model> x2])
midpt = CurveMiddle(Curve=crv)
mjoin = MeshJoin(Meshes=mesh)
partition = PartitionList(List=anchor, Size=Slider(2, range=0..10))  # -> flatten(Chunks)
partition_2 = PartitionList(List=pull, Size=Slider(3, range=0..10))
graft = GraftTree(Tree=crv, IncludeEmptyLists=True, IncludeNullItems=True)
refine = Refine(Mesh=mjoin, Level=Slider(0, range=0..3))
points = PointList(Points=midpt, Size=Slider(150, range=0..1000))
anchorxyz = AnchorXYZ(Point=edge_points, X=invert(False), Y=invert(False), Z=False, Strength=1000)
nv = NakedVertices(Mesh=refine)  # -> ClothedIndex, NakedIndex, ClothedPts, NakedPts
anchor_2 = Anchor(Point=partition, Strength=10000)
oncurve = OnCurve(Points=partition_2, Curve=graft, Strength=1)
show = Show(G=refine)
Z = UnitZ(Factor=Slider(11.414, range=0..20))
edgelengths = EdgeLengths(Mesh=refine, LengthFactor=Slider(0.751, range=0..1), Strength=1)
load = Load(Point=nv.ClothedPts, ForceVector=Z, Weighting=1)
entwine = Entwine(Branch00=edgelengths, Branch01=anchor_2, Branch02=oncurve, Branch03=load, Branch04=anchorxyz, FlattenInputs=True)
merge = Merge(Data1=show, Data2=entwine)
falsestart = LBFalseStartToggle(False)
bouncysolver = BouncySolver(
    GoalObjects=merge,
    Reset=Button(),
    Threshold=1e-15,
    Tolerance=Slider(0.3362, range=0..1),
    Damping=Slider(0.9, range=0..1),
    Iterations=10,
    On=falsestart)  # -> I, V, O
panel = Panel(bouncysolver.O)
item = ListItem(List=bouncysolver.O, Index=0, Wrap=True)
wbcatmullclark = WeaverbirdsCatmullClarkSubdivision(MeshCurves=item, Level=1, SmoothNakedEdges=1)
