# Grasshopper definition landscape tiles scaled.gh (Grasshopper 1.0.8)
# plug-ins: Heteroptera, Pufferfish

number_slider = Slider(0.25, range=0..1)
rectangular = Rectangular(
    Plane=PlaneXY(0, 0, 0),
    SizeX=number_slider,
    SizeY=number_slider,
    ExtentX=Slider(52, range=0..100),
    ExtentY=Slider(30, range=0..100))  # -> Cells, flatten(Points)
point = Point(rectangular.Points)
bounding_box = BoundingBox(Content=flatten(rectangular.Cells), Plane=PlaneXY(0, 0, 0), UnionBox=True)  # -> Box, Box_2

xy_plane = XYPlane(Origin=Point(0, 0, 0))
bounding_rectangle = BoundingRectangle(Geometry=bounding_box.Box, Plane=xy_plane, Axis=0, Slide=0, Union=True)  # -> Bounding, DimensionX, DimensionY
center = Center(Geometry=bounding_rectangle.Bounding)  # -> Center, Dimension
scale = Scale(Geometry=bounding_rectangle.Bounding, Center=center.Center, Factor=Slider(0.81, range=0..1))  # -> Geometry, Transform
populate_2d = Populate2D(Region=scale.Geometry, Count=Slider(5, range=0..10), Seed=1)
point_2 = Point(populate_2d)
pull_point = PullPoint(Point=flatten(rectangular.Points), Geometry=point_2, ClosestOnly=True)  # -> ClosestPoint, Distance, Index
minimum = Minimum(A=pull_point.Distance, B=Slider(1.24, range=0..2))
construct_domain = ConstructDomain(DomainStart=Slider(0.201, range=0..1), DomainEnd=Slider(0, range=0..1))
bounds = Bounds(Numbers=minimum)
remap_numbers = RemapNumbers(Value=minimum, Source=bounds, Target=construct_domain)  # -> Mapped, Clipped

circle = Circle(Plane=point_2, Radius=Slider(0.39, range=0..1))
number_slider_2 = Slider(0.11, range=0..1)
boundary_surfaces = BoundarySurfaces(Edges=circle)
unit_z = UnitZ(Factor=Slider(0.07, range=0..1))
extrude = Extrude(Base=boundary_surfaces, Direction=unit_z)
construct_domain_2 = ConstructDomain(DomainStart=expr("-x", number_slider_2), DomainEnd=number_slider_2)
construct_domain_3 = ConstructDomain(DomainStart=expr("-x", number_slider_2), DomainEnd=number_slider_2)
rectangle = Rectangle(Plane=point_2, XSize=construct_domain_2, YSize=construct_domain_3, Radius=0)  # -> Rectangle, Length

list_length = ListLength(List=point)
random = Random(Range="-1 to 1", Number=list_length, Seed=Slider(12, range=0..100))
random_2 = Random(Range="-1 to 1", Number=list_length, Seed=Slider(28, range=0..100))
vector_xyz = VectorXYZ(XComponent=random, YComponent=random_2, ZComponent=0)  # -> Vector, Length
amplitude = Amplitude(Vector=vector_xyz.Vector, Amplitude=remap_numbers.Mapped)

move = Move(Geometry=rectangle.Rectangle, Motion=unit_z)  # -> Geometry, Transform
boundary_surfaces_2 = BoundarySurfaces(Edges=move.Geometry)
unit_z_2 = UnitZ(Factor=Slider(0.77, range=0..10))
extrude_2 = Extrude(Base=boundary_surfaces_2, Direction=unit_z_2)
move_2 = Move(Geometry=point, Motion=amplitude)  # -> Geometry, Transform
voronoi = Voronoi(Points=flatten(move_2.Geometry), Boundary=bounding_box.Box, BruteForceOverride=False)
area = Area(Geometry=voronoi)  # -> Area, Centroid

pull_point_2 = PullPoint(Point=flatten(area.Centroid), Geometry=point_2, ClosestOnly=True)  # -> ClosestPoint, Distance, Index
minimum_2 = Minimum(A=pull_point_2.Distance, B=Slider(1.24, range=0..2))
construct_domain_4 = ConstructDomain(DomainStart=Slider(0.235, range=0..1), DomainEnd=Slider(0.935, range=0..1))
bounds_2 = Bounds(Numbers=minimum_2)
remap_numbers_2 = RemapNumbers(Value=minimum_2, Source=bounds_2, Target=construct_domain_4)  # -> Mapped, Clipped

scale_2 = Scale(Geometry=voronoi, Center=area.Centroid, Factor=remap_numbers_2.Mapped)  # -> Geometry, Transform
area_2 = Area(Geometry=scale_2.Geometry)  # -> Area, Centroid
closest_point = ClosestPoint(Point=point_2, Cloud=area_2.Centroid)  # -> ClosestPoint, CPIndex, Distance
discontinuity = Discontinuity(Curve=scale_2.Geometry, Level=1)  # -> Points, Parameters

pull_point_3 = PullPoint(Point=discontinuity.Points, Geometry=closest_point.ClosestPoint, ClosestOnly=True)  # -> ClosestPoint, Distance, Index
minimum_3 = Minimum(A=pull_point_3.Distance, B=Slider(1.24, range=0..2))
construct_domain_5 = ConstructDomain(DomainStart=Slider(0.031, range=0..1), DomainEnd=Slider(0.006, range=0..1))
bounds_3 = Bounds(Numbers=minimum_3)
remap_numbers_3 = RemapNumbers(Value=minimum_3, Source=bounds_3, Target=construct_domain_5)  # -> Mapped, Clipped

vector_2pt = Vector2Pt(PointA=discontinuity.Points, PointB=pull_point_3.ClosestPoint, Unitize=False)  # -> Vector, Length
amplitude_2 = Amplitude(Vector=vector_2pt.Vector, Amplitude=remap_numbers_3.Mapped)
reverse = Reverse(Vector=amplitude_2)
move_3 = Move(Geometry=discontinuity.Points, Motion=reverse)  # -> Geometry, Transform
polyline = PolyLine(Vertices=move_3.Geometry, Closed=invert(False))
