# Grasshopper definition shadows.gh (Grasshopper 0.9.76)
# plug-ins: Python Interpreter

# ----
# Imported weather file
panel = Panel("http://apps1.eere.energy.gov/buildings/energyplus/weatherdata/6_europe_wmo_region_6/GBR_Leuchars.031710_IWEC.zip")
open_epw_stat = Ladybug_OpenEPWAndSTATWeatherFiles(weatherFileURL=panel)  # -> epwFile, statFile; plug-in component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
importepw = Ladybug_ImportEpw(epwFile=open_epw_stat.epwFile)  # -> readMe, latitude, location, dryBulbTemperature, dewPointTemperature, relativeHumidity, windSpeed, windDirection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; plug-in component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

ladybug = Ladybug_Ladybug()  # -> Vviiiiiiiiiizzz; plug-in component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
downloadepw = Ladybug_downloadEPWWeatherFile(download=Toggle(True))  # -> readMe; plug-in component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
series = Series(Start=1, Step=1, Count=24)
explodelocation = Ladybug_DecomposeLocation(location=importepw.location)  # -> locationName, latitude, longitude, timeZone, elevation; plug-in component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
panel_2 = Panel(series)
sunpath = Ladybug_SunPath(
    north=explodelocation.locationName,
    hour=series,
    day=Slider(21, range=0..100),
    month=Slider(1, range=0..1),
    timeStep=1,
    dailyOrAnnualSunPath=True)  # -> readMe, sunVectors, sunAltitudes, sunAzimuths, port, sunSpheresMesh, sunPathCrvs, legend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; plug-in component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
legendpar = Ladybug_LegendParameters()  # -> legendPar; plug-in component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
brep = Brep([<brep referenced from the Rhino model> x5])
ground = Brep(<brep referenced from the Rhino model>)
brep_wireframe = BrepWireframe(Brep=[brep, ground], Density=-1)
sunlighthoursanalysis = Ladybug_SunlightHoursAnalysis(
    geometry=flatten([brep, ground]),
    gridSize=Slider(0.5, range=0..1),
    disFromBase=Slider(0.1, range=0..0.1),
    sunVectors=flatten(sunpath.sunVectors),
    timeStep=1,
    legendPar=flatten(legendpar),
    parallel=Toggle(True),
    runIt=Toggle(True))  # -> readMe, contextMesh, analysisMesh, testPts, testVec, port, sunlightHoursResult, sunlightHoursMesh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; plug-in component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
panel_3 = Panel(sunlighthoursanalysis.readMe)
mesh = Mesh(sunlighthoursanalysis.sunlightHoursMesh)
