# Grasshopper definition shortestPath_withSlope.gh (Grasshopper 1.0.8)
# plug-ins: Noise 4D, Wombat

number_slider = Slider(1000, range=0..1000)
xy = XYPlane(Origin=Point(0, 0, 0))
dom = ConstructDomain(DomainStart=expr("-x", number_slider), DomainEnd=expr("1.5*x", number_slider))
dom_2 = ConstructDomain(DomainStart=expr("-x", number_slider), DomainEnd=number_slider)
rectangle = Rectangle(Plane=xy, XSize=dom_2, YSize=dom, Radius=0)  # -> Rectangle, Length
number_slider_2 = Slider(12, range=0..100)
srf = Surface(rectangle.Rectangle)
sdivide = DivideSurface(Surface=srf, UCount=number_slider_2, VCount=Slider(12, range=0..100))  # -> Points, Normals, Parameters
perlin = PerlinNoise(Values=sdivide.Points, Time=Slider(0.73, range=0..1), Scale=Slider(20, range=0..100))
pdecon = Deconstruct(Point=sdivide.Points)  # -> XComponent, YComponent, ZComponent
pt = ConstructPoint(XCoordinate=pdecon.XComponent, YCoordinate=pdecon.YComponent, ZCoordinate=expr("1000*x", perlin))
srfgrid = SurfaceFromPoints(Points=flatten(pt), UCount=expr("x+1", number_slider_2), Interpolate=False)
md_slider = MDSlider(
    SliderMode=0,
    slider_value=Point(0.4285222834, 0.9986581608, 0.5),
    x_domain=Domain(0, 1),
    y_domain=Domain(0, 1),
    z_domain=Domain(0, 1))
md_slider_2 = MDSlider(
    SliderMode=0,
    slider_value=Point(0.770577567, 0.003172271106, 0.5),
    x_domain=Domain(0, 1),
    y_domain=Domain(0, 1),
    z_domain=Domain(0, 1))
srf_2 = Surface(srfgrid)
evalsrf = EvaluateSurface(Surface=reparameterize(srf_2), Point=md_slider)  # -> Point, Normal, UDirection, VDirection, Frame
evalsrf_2 = EvaluateSurface(Surface=reparameterize(srf_2), Point=md_slider_2)  # -> Point, Normal, UDirection, VDirection, Frame

preview = CustomPreview(Geometry=srf_2, Material=ColourSwatch(SwatchColor=RGB(214, 184, 184)))

# ---- group: Starting Point
pt_2 = Point(evalsrf.Point)

# ---- group: Ending Point
pt_3 = Point(evalsrf_2.Point)

# ----
ln = Line(StartPoint=pt_2, EndPoint=pt_3)
divide = DivideCurve(Curve=ln, Count="20", Kinks=False)  # -> Points, Tangents, Parameters
cull_ends = CullEnds(List=divide.Points)  # -> List, Culled
item = ListItem(List=divide.Points, Index=0, Wrap=True)  # -> Item1, Item
genes = GenePool(
    Decimals=2,
    Maximum=600,
    Minimum=-600,
    Value=[-459.7, -491.33, -340.78, -280.71, -235.79, -151.66, -16.88, 65.07, 132.86, 134.38])
X = UnitX(Factor=1)
multiplication = Multiplication(A=genes, B=X)
panel = Panel("""0
-1""")
move = Move(Geometry=cull_ends.List, Motion=multiplication)  # -> Geometry, Transform
merge = Merge(Data1=item.Item, Data2=item.Item1)
ins = InsertItems(List=move.Geometry, Item=merge, Indices=panel, Wrap=True)
intcrv = Interpolate(Vertices=ins, Degree=3, Periodic=False, KnotStyle=1)  # -> Curve, Length, Domain
Z = UnitZ(Factor=1)
project = ProjectCurve(Curve=intcrv.Curve, Brep=srf_2, Direction=Z)
len = Length(Curve=project)
divide_2 = DivideCurve(Curve=project, Count=Slider(80, range=0..100), Kinks=False)  # -> Points, Tangents, Parameters
ma = MassAddition(Input=len)  # -> Result, PartialResults
pline = PolyLine(Vertices=divide_2.Points, Closed=False)
panel_2 = Panel(ma.PartialResults)
explode = Explode(Curve=pline, Recursive=True)  # -> Segments, Vertices
end = EndPoints(Curve=explode.Segments)  # -> Start, End
num = Number(panel_2)
xy_2 = XYPlane(Origin=end.Start)
galapagos = Galapagos(fitness=num, gene=genes)
angle = Angle(VectorA=explode.Segments, VectorB=xy_2)  # -> Angle, Reflex
bnd = Bounds(Numbers=angle.Angle)
avr = Average(Input=angle.Angle)
dedomain = DeconstructDomain(Domain=bnd)  # -> Start, End
panel_3 = Panel(dedomain.End)
panel_4 = Panel(avr)
gradient = Gradient(
    LowerLimit=dedomain.Start,
    UpperLimit=dedomain.End,
    Parameter=angle.Angle,
    stops=[0: RGB(243, 57, 0), 0.1: RGB(236, 27, 60), 0.2: RGB(210, 0, 118), 0.3: RGB(103, 0, 120), 0.4: RGB(39, 72, 161), 0.5: RGB(1, 192, 229), 0.6: RGB(18, 178, 90), 0.7: RGB(79, 186, 8), 0.8: RGB(220, 237, 32), 0.9: RGB(247, 159, 20), 1: RGB(243, 57, 0)])
pipe = Pipe(Curve=explode.Segments, Radius=Slider(5, range=0..100), Caps=0)  # -> flatten(Pipe)
preview_2 = CustomPreview(Geometry=pipe, Material=gradient)
