# Grasshopper definition sinCos_Curve.gh (Grasshopper 1.0.8)

c_script = CSharpScript(x=Slider(9, range=0..10), y=Slider(18, range=0..100))  # -> out, a, b, c; inputs x: Int32, y: Int32
# ---------- c_script: C# ----------
// Grasshopper Script Instance
#region Usings

using System;
using System.Linq;
using System.Collections;
using System.Collections.Generic;
using System.Drawing;

using Rhino;
using rg = Rhino.Geometry;

using Grasshopper;
using Grasshopper.Kernel;
using Grasshopper.Kernel.Data;
using Grasshopper.Kernel.Types;
#endregion

public class Script_Instance : GH_ScriptInstance
{
    #region Notes
    /* 
      Members:
        RhinoDoc RhinoDocument
        GH_Document GrasshopperDocument
        IGH_Component Component
        int Iteration

      Methods (Virtual & overridable):
        Print(string text)
        Print(string format, params object[] args)
        Reflect(object obj)
        Reflect(object obj, string method_name)
    */
    #endregion

    private void RunScript(int x, int y, ref object a, ref object b, ref object c)
    {
        List<rg.Point3d> basePoint = new List<rg.Point3d>();
        List<rg.Point3d> raPoint = new List<rg.Point3d>();

        for (int i = 0; i < x; i++) {
            
            rg.Point3d fPoint = new rg.Point3d(i, Math.Sin(i), 0);
            basePoint.Add(fPoint);

        }

        for (int j = 0; j < y; j++) {
                        
            rg.Point3d sPoint = new rg.Point3d(j, Math.Cos(j), 10);
            raPoint.Add(sPoint);

        }

        rg.Curve lCurve = rg.Curve.CreateInterpolatedCurve(basePoint, 3);
        rg.Curve tCurve = rg.Curve.CreateInterpolatedCurve(raPoint, 3);

        a = lCurve;
        b = tCurve;

        rg.Surface simSurf = rg.NurbsSurface.CreateRuledSurface(lCurve, tCurve);
        
        c = simSurf;

       
    }
}
# ---------- end c_script ----------
