# Grasshopper definition surface morph.gh (Grasshopper 1.0.8)

xy_plane = XYPlane(Origin=Point(0, 0, 0))
rectangle = Rectangle(Plane=xy_plane, XSize=Slider(50, range=0..100), YSize=Slider(50, range=0..100), Radius=Slider(5, range=0..10))  # -> Rectangle, Length
unit_z = UnitZ(Factor=Slider(50, range=0..100))
extrude = Extrude(Base=rectangle.Rectangle, Direction=unit_z)
dimensions = Dimensions(Surface=extrude)  # -> UDimension, VDimension
xy_plane_2 = XYPlane(Origin=Point(0, 0, 0))
rectangle_2 = Rectangle(Plane=xy_plane_2, XSize=dimensions.UDimension, YSize=dimensions.VDimension, Radius=0)  # -> Rectangle, Length
populate_3d = Populate3D(Region=rectangle_2.Rectangle, Count=Slider(800, range=0..1000), Seed=1)
voronoi = Voronoi(Points=populate_3d, Boundary=rectangle_2.Rectangle, BruteForceOverride=False)
polygon_center = PolygonCenter(Polyline=voronoi)  # -> CenterV, CenterE, CenterA
curve = Curve(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)
curve_closest_point = CurveClosestPoint(Point=polygon_center.CenterV, Curve=curve)  # -> Point, Parameter, Distance
sort_list = SortList(Keys=curve_closest_point.Distance)  # -> reverse(Keys), ValuesA
list_item = ListItem(List=sort_list.Keys, Index=0, Wrap=True)
multiplication = Multiplication(A=list_item, B=Slider(0.27, range=0..10))
smaller_than = SmallerThan(FirstNumber=curve_closest_point.Distance, SecondNumber=multiplication)  # -> SmallerThan, OrEqualTo
cull_pattern = CullPattern(List=voronoi, CullPattern=smaller_than.SmallerThan)
cull_pattern_2 = CullPattern(List=polygon_center.CenterV, CullPattern=smaller_than.SmallerThan)
cull_pattern_3 = CullPattern(List=curve_closest_point.Distance, CullPattern=smaller_than.SmallerThan)
construct_domain = ConstructDomain(DomainStart=Slider(0.95, range=0..1), DomainEnd=Slider(0.16, range=0..1))
bounds = Bounds(Numbers=flatten(cull_pattern_3))
remap_numbers = RemapNumbers(Value=cull_pattern_3, Source=bounds, Target=construct_domain)  # -> Mapped, Clipped
scale = Scale(Geometry=cull_pattern, Center=cull_pattern_2, Factor=remap_numbers.Mapped)  # -> Geometry, Transform
explode = Explode(Curve=scale.Geometry, Recursive=True)  # -> Segments, Vertices
point_on_curve = PointOnCurve(explode.Segments, parameter=0.5)
nurbs_curve = NurbsCurve(Vertices=point_on_curve, Degree=3, Periodic=invert(False))  # -> Curve, Length, Domain
boundary_surfaces = BoundarySurfaces(Edges=flatten([rectangle_2.Rectangle, nurbs_curve.Curve]))
unit_z_2 = UnitZ(Factor=Slider(1, range=0..1))
extrude_2 = Extrude(Base=boundary_surfaces, Direction=unit_z_2)
number_slider = Slider(1, range=0..1)
bounding_box = BoundingBox(Content=flatten(extrude_2), Plane=PlaneXY(0, 0, 0), UnionBox=True)  # -> Box, Box_2
surface_morph = SurfaceMorph(
    Geometry=extrude_2,
    Reference=bounding_box.Box,
    Surface=reparameterize(extrude),
    UDomain=number_slider,
    VDomain=number_slider,
    WDomain=number_slider)
