# Grasshopper definition voronoi group.gh (Grasshopper 1.0.8)
# plug-ins: Human

number_slider = Slider(100, range=0..100)
xy = XYPlane(Origin=Point(0, 0, 0))
merge = Merge(Data1=Slider(59, range=0..100), Data2=Slider(197, range=0..1000))
rectangle = Rectangle(Plane=xy, XSize=number_slider, YSize=number_slider, Radius=0)  # -> Rectangle, Length
pop2d = Populate2D(Region=rectangle.Rectangle, Count=merge, Seed=Slider(5, range=0..10))  # -> simplify(Population)
bang = ExplodeTree(Data=pop2d)  # -> Branch0, Branch1
number_slider_2 = Slider(0.5, range=0..1)
vorgroup = VoronoiGroups(Boundary=rectangle.Rectangle, Generation1=bang.Branch0, Generation2=bang.Branch1)  # -> Diagram1, Diagram2
merge_2 = Merge(Data1=number_slider_2, Data2=Slider(0.2, range=0..1))  # -> graft(Result)
entwine = Entwine(Branch00=vorgroup.Diagram1, Branch01=vorgroup.Diagram2, FlattenInputs=True)
offset = OffsetCurve(Curve=rectangle.Rectangle, Distance=expr("-x", number_slider_2), Corners=1)
offset_2 = OffsetCurve(Curve=entwine, Distance=expr("-x", merge_2), Corners=1)
merge_3 = Merge(Data1=simplify(graft(entwine)), Data2=simplify(offset_2))
area = Area(Geometry=offset)  # -> Area, Centroid
number_slider_3 = Slider(12.7, range=0..15)
scale = Scale(Geometry=offset, Center=area.Centroid, Factor=Slider(1.1, range=0..10))  # -> Geometry, Transform
loft = Loft(Curves=merge_3, Options={Adjust=False, Closed=False, LoftEnds=0, LoftSimp=0, LoftType=0, Rebuild=10, Refit=0.01})
boundary = BoundarySurfaces(Edges=offset)
boundary_2 = BoundarySurfaces(Edges=flatten([scale.Geometry, offset]))
sdivide = DivideSurface(Surface=boundary, UCount="2", VCount="2")  # -> flatten(Points), Normals, Parameters
expression = Expression(x=number_slider_3, d=Slider(1.3, range=1..2), Expression="x*d")
Z = UnitZ(Factor=1)
area_2 = Area(Geometry=boundary)  # -> Area, Centroid
extr = Extrude(Base=boundary_2, Direction=Z)
merge_4 = Merge(Data1=expression, Data2=number_slider_3)  # -> graft(Result)
avr = Average(Input=sdivide.Points)
number_slider_4 = Slider(1.1, range=0..10)
dam = DataDam(DataA=loft, DataB=extr, BufferDelay=10000000, BufferMode=0)  # -> DataA, DataB
Z_2 = UnitZ(Factor=merge_4)
trim = TrimSolid(Shape=dam.DataA, Cutters=dam.DataB)  # -> simplify(Result)
move = Move(Geometry=avr, Motion=Z_2)  # -> Geometry, Transform
Z_3 = UnitZ(Factor=1)
scale_2 = Scale(Geometry=boundary, Center=area_2.Centroid, Factor=number_slider_4)  # -> Geometry, Transform
replace = ReplaceMembers(Set=sdivide.Points, Find=avr, Replace=move.Geometry)
pshift = ShiftPaths(Data=trim, Offset=Z_3)
srfgrid = SurfaceFromPoints(Points=replace, UCount=expr("x+1", "2"), Interpolate=False)
Z_4 = UnitZ(Factor=expr("-x", number_slider_4))
Z_5 = UnitZ(Factor=number_slider_3)
Z_6 = UnitZ(Factor=expression)
extr_2 = Extrude(Base=scale_2.Geometry, Direction=Z_4)
extr_3 = Extrude(Base=pshift, Direction=Z_5)
extr_4 = Extrude(Base=srfgrid, Direction=Z_6)
sdiff = SolidDifference(BrepsA=extr_3, BrepsB=extr_4)
previewmat = CustomPreviewMaterials(Geometry=sdiff, DiffuseColor=ColourSwatch(SwatchColor=RGB(255, 255, 255)))
previewmat_2 = CustomPreviewMaterials(Geometry=extr_2, DiffuseColor=ColourSwatch(SwatchColor=RGB(255, 255, 255)))
